# Grasshopper definition 101_brick_to_robot.ghx (Grasshopper 1.0.8)
# plug-ins: Bifocals

# ---- group: 03 / CHECK + VIEW
upright_mode = BooleanToggle(False)
odd_gap = Slider(1, range=0.1..8)
display_mode = Slider(1, range=0..2)

# ---- group: 01 / LONGITUDINAL BRIDGE
# 01_ 2 Columns/ 258 Bricks / 19 Layers
num_layers = Slider(10, range=7..31)
even_to_odd = Slider(6.98, range=0..12)
heading_deg = Slider(-63.13, range=-180..180)
closing_gap = Slider(8.46, range=1..20)
gap = Slider(1, range=0.3..5)
odd_to_even = Slider(2, range=0..5)
even_columns = Slider(4, range=4..5)

# ---- group: 02 / SINGLE ROTATION INPUT
rot_step = Slider(3.5, range=-5..5)

# ---- group: This is needed only ONCE in the GH definition
enable_auto_reload = Python3Script()  # -> ok
# ---------- enable_auto_reload: Python ----------
"""
------------------------------
Using VS Code as Python editor
------------------------------

The simplest way to start using VS Code as our editor, is
to place our Python code in files located IN THE SAME FOLDER as our Grasshopper file.

After we have done that, we need 2 steps: 

1. Enable the COMPAS reloader on one component. This tells Grasshopper to watch for changes in the Pythoh files and reload if changed.
2. Every other component that uses Python code from external files needs to start with a method to ensure Grasshopper knows where to load the files from.

"""
# r: compas
# venv: mas-2627

from compas_rhino.devtools import DevTools
DevTools.enable_reloader()
# ---------- end enable_auto_reload ----------

# ----
plan_2_even_upright = ForwardCorbelBridgeGenerator(
    num_layers=num_layers,
    even_to_odd=even_to_odd,
    heading_deg=heading_deg,
    closing_gap=closing_gap,
    gap=gap,
    odd_to_even=odd_to_even,
    even_columns=even_columns,
    rot_step=rot_step,
    odd_gap=odd_gap,
    display_mode=display_mode,
    upright_mode=upright_mode)  # -> out, geometry, spine, frames, issues, report, data, order, contacts, course_info; inputs num_layers: Int32, even_to_odd: Double, heading_deg: Double, closing_gap: Double, gap: Double, odd_to_even: Double, even_columns: Int32, rot_step: Double, odd_gap: Double, display_mode: Int32, upright_mode: Boolean
# ---------- plan_2_even_upright: Python ----------
# venv: mas-2627
import math
def generate(num_layers=19,even_to_odd=8.,odd_to_even=2.,heading_deg=-31.5,closing_gap=8.,gap=1.,odd_gap=1.,even_columns=4,rot_step=3.5):
    n=int(num_layers);ec=int(even_columns)
    if n!=num_layers or not 7<=n<=31 or ec not in (4,5):raise ValueError('Use 7..31 layers and 4 or 5 even columns.')
    if not all(math.isfinite(float(v)) for v in (even_to_odd,odd_to_even,heading_deg,closing_gap,gap,odd_gap,rot_step)):raise ValueError('Use finite numbers.')
    if min(gap,odd_gap,closing_gap)<=0 or min(even_to_odd,odd_to_even)<0:raise ValueError('Use positive gaps and nonnegative advances.')
    yaw=[math.radians(heading_deg+i*rot_step) for i in range(n)];last=n-2
    half=(ec*15+(ec-1)*gap)/2 if last%2 else (64+odd_gap)/2
    centres=[[0.,0.] for i in range(n-1)];centres[last]=[(half+closing_gap/2)*math.cos(yaw[last]),(half+closing_gap/2)*math.sin(yaw[last])]
    for i in range(last-1,-1,-1):
        advance=odd_to_even if (i+1)%2 else even_to_odd
        centres[i]=[centres[i+1][j]+advance*(math.cos(yaw[i]) if j==0 else math.sin(yaw[i])) for j in (0,1)]
    records=[];courses=[];fronts=[];info=[];bed_z=0.
    for i in range(n):
        a=yaw[i];c,s=math.cos(a),math.sin(a);floor=[]
        upright=bool(i%2);width=10. if upright else 15.;height=15. if upright else 10.
        if i==n-1:
            crown_gap=gap if upright else odd_gap
            grid=[(u,v,'crown') for u in (-(32+crown_gap),0,32+crown_gap) for v in (-(15+crown_gap)/2,(15+crown_gap)/2)];angle=a
        else:
            cross=bool(i%2);angle=a+(math.pi/2 if cross else 0)
            us=[(j-(ec-1)/2)*(15+gap) for j in range(ec)] if cross else [-(32+odd_gap)/2,(32+odd_gap)/2]
            vs=[-(32+gap)/2,(32+gap)/2] if cross else [-(15+odd_gap),0,15+odd_gap]
            grid=[(u,v,branch) for branch in ('left','right') for u in sorted(us,key=lambda u:-abs(u)) for v in vs]
        for u,v,branch in grid:
            side=-1 if branch=='left' else 1;cx,cy=(0,0) if branch=='crown' else (side*centres[i][0],side*centres[i][1])
            ident='L%02d-B%03d'%(i+1,len(floor)+1);b=dict(id=ident,level=i,center=[cx+c*u-s*v,cy+s*u+c*v,bed_z+height/2],angle=angle,size=[32.,width,height],pose='B2_UPRIGHT' if upright else 'B1',branch=branch,brick_type='upright' if upright else 'flat')
            floor.append(ident);records.append(b)
        courses.append(floor);fronts.append([0,0]);info.append(dict(layer=i+1,bricks=len(floor),bed_z=bed_z,height=height,top_z=bed_z+height,yaw_deg=heading_deg+i*rot_step))
        bed_z+=height
    return dict(records=records,order=[b['id'] for b in records],courses=courses,layer_info=info,course_yaws=yaw,fronts=fronts,height=bed_z,design='PLAN 2 / EVEN COURSES UPRIGHT',parameters=locals().get('n'))

def _outside_in(result):
    """Bottom to top, then farthest to nearest the shared XY arch centre.

    Run after geometry/collision selection so it cannot change which bricks
    exist. Python's stable sort retains the previous order for equal radii.
    """
    result['records']=sorted(result['records'],key=lambda b:(int(b['level']),-round(b['center'][0]**2+b['center'][1]**2,8)))
    result['order']=[b['id'] for b in result['records']]
    courses=[[] for _ in result['courses']]
    for b in result['records']:courses[int(b['level'])].append(b['id'])
    result['courses']=courses
    result['placement_rule']='bottom_to_top_then_outside_to_inside_xy'
    return result


def preview_and_data(result,show,detail):
    import json,Rhino.Geometry as rg
    geometry=[];frames=[]
    if show:
        for b in result['records']:
            x,y,z=b['center'];a=b['angle'];p=rg.Plane(rg.Point3d(x,y,z),rg.Vector3d(math.cos(a),math.sin(a),0),rg.Vector3d(-math.sin(a),math.cos(a),0));length,width,height=b['size'];box=rg.Box(p,rg.Interval(-length/2,length/2),rg.Interval(-width/2,width/2),rg.Interval(-height/2,height/2));geometry.append(rg.Mesh.CreateFromBox(box,1,1,1))
            if show==2:frames.append(p)
    data=json.dumps(dict(schema='JW_LIGHT_V18',design=result['design'],records=result['records'],order=result['order']),separators=(',',':'))
    report=('EVEN COURSES UPRIGHT / GEOMETRY VARIANT\n'
        'Odd courses: 32 x 15 x 10 mm. Even courses: 32 x 10 x 15 mm.\n'
        'Same original XY centres, column counts, layer yaw and bank advance.\n'
        'Even-course centre spacing is preserved: clear gaps grow by 5 mm.\n'
        'Course elevations accumulate the actual 10 / 15 mm heights.\n'
        'Current height: %.1f mm; %d courses; %d bricks.\n'
        'Robot pickup/reorientation code is unchanged; upright handling is not implemented.'
        %(result['height'],len(result['courses']),len(result['records'])))
    report='PLACEMENT: bottom to top; each course from outside towards centre. Equal-radius bricks keep the prior order.\n'+report
    return geometry,[],frames,[],report,data,result['order'],[],[]

# Pure Python geometry correction for the all-flat variant only.
import math

def _fa35_constraints(shapes, clearance):
    pairs=[]
    for i,a in enumerate(shapes):
        for j,b in enumerate(shapes[:i]):
            axes=[]
            for ux,uy in ((a[0],a[1]),(-a[1],a[0]),(b[0],b[1]),(-b[1],b[0])):
                ra=a[2]*abs(ux*a[0]+uy*a[1])+a[3]*abs(-ux*a[1]+uy*a[0])
                rb=b[2]*abs(ux*b[0]+uy*b[1])+b[3]*abs(-ux*b[1]+uy*b[0])
                axes.append((ux,uy,ra+rb+clearance))
            pairs.append((i,j,axes))
    return pairs

def _fa35_separation(xy, pair):
    i,j,axes=pair;dx=xy[i][0]-xy[j][0];dy=xy[i][1]-xy[j][1]
    best=1e100;bx=by=0.
    for ux,uy,distance in axes:
        dot=dx*ux+dy*uy;penetration=distance-abs(dot)
        if penetration<=0.:return 0.,0.,0.
        if penetration<best:
            sign=1. if dot>=0 else -1.
            best=penetration;bx=sign*ux;by=sign*uy
    return best,bx,by

def _fa35_stagger_rows(bricks,xy,clearance):
    """Keep the photo's column positions; spread its two staggered rows.

    The original upright 6-brick bond has a 25mm row pitch along each
    brick's 32mm axis. Flat conversion needs 32+gap instead. Translating
    whole rows is less disruptive than widening every staggered column.
    """
    groups={}
    for i,b in enumerate(bricks):
        if 'bond_row' not in b or b.get('branch')=='neck':continue
        upright=b.get('_fa35_source_upright')
        if upright is None:
            ident=b.get('id','');mark=ident.rfind('I04-L')
            upright=mark>=0 and int(ident[mark+5:mark+7])%2==0
        if not upright:continue
        angle=float(b['angle'])%math.pi
        # Custom rotated upper repair bricks form a separate group.
        key=(b.get('arch'),b.get('branch'),round(angle,7))
        groups.setdefault(key,[]).append(i)
    changed=0
    for key,indices in groups.items():
        rows={r:[i for i in indices if int(bricks[i]['bond_row'])==r] for r in (0,1)}
        if not rows[0] or not rows[1]:continue
        ux,uy=math.cos(key[2]),math.sin(key[2])
        means=[sum(xy[i][0]*ux+xy[i][1]*uy for i in rows[r])/len(rows[r]) for r in (0,1)]
        difference=means[1]-means[0];extra=max(0.,32.+clearance+1e-5-abs(difference))
        if extra<=1e-7:continue
        sign=1. if difference>=0 else -1.
        # Retain each group's centroid even when earlier merge has culled
        # unequal numbers from the two rows.
        total=len(rows[0])+len(rows[1])
        shifts=(-sign*extra*len(rows[1])/total,sign*extra*len(rows[0])/total)
        for row in (0,1):
            for i in rows[row]:xy[i][0]+=shifts[row]*ux;xy[i][1]+=shifts[row]*uy
        changed+=1
    return changed

def _fa35_polygon(b):
    c,s=math.cos(b['angle']),math.sin(b['angle']);x,y=b['center'][:2]
    l,w=b['size'][0]/2.,b['size'][1]/2.
    return [(x+c*u-s*v,y+s*u+c*v) for u,v in ((-l,-w),(l,-w),(l,w),(-l,w))]

def _fa35_clip(subject,clip):
    output=list(subject)
    for j,a in enumerate(clip):
        b=clip[(j+1)%len(clip)];src=output;output=[]
        if not src:break
        dx,dy=b[0]-a[0],b[1]-a[1]
        for k,p in enumerate(src):
            q=src[k-1];dp=dx*(p[1]-a[1])-dy*(p[0]-a[0]);dq=dx*(q[1]-a[1])-dy*(q[0]-a[0])
            if (dp>=-1e-9)!=(dq>=-1e-9):
                t=dq/(dq-dp);output.append((q[0]+t*(p[0]-q[0]),q[1]+t*(p[1]-q[1])))
            if dp>=-1e-9:output.append(p)
    return output

def _fa35_margin(point,points):
    pts=sorted(set(points))
    if len(pts)<3:return -1e9
    def cross(o,a,b):return (a[0]-o[0])*(b[1]-o[1])-(a[1]-o[1])*(b[0]-o[0])
    lower=[];upper=[]
    for p in pts:
        while len(lower)>=2 and cross(lower[-2],lower[-1],p)<=1e-10:lower.pop()
        lower.append(p)
    for p in reversed(pts):
        while len(upper)>=2 and cross(upper[-2],upper[-1],p)<=1e-10:upper.pop()
        upper.append(p)
    hull=lower[:-1]+upper[:-1]
    if len(hull)<3:return -1e9
    return min(((b[0]-a[0])*(point[1]-a[1])-(b[1]-a[1])*(point[0]-a[0]))/max(1e-12,math.hypot(b[0]-a[0],b[1]-a[1])) for a,b in zip(hull,hull[1:]+hull[:1]))

def _fa35_repair_below(records,clearance):
    """Bounded support-only nudges; never remove or rotate a brick."""
    floors={};polys=[_fa35_polygon(b) for b in records];support_origins=[list(b['center'][:2]) for b in records]
    for i,b in enumerate(records):floors.setdefault(int(b['level']),[]).append(i)
    bounds=[(min(x for x,y in p),min(y for x,y in p),max(x for x,y in p),max(y for x,y in p)) for p in polys]
    below={i:[] for i in range(len(records))};above={i:[] for i in range(len(records))};patches={}
    for i,b in enumerate(records):
        for j in floors.get(int(b['level'])-1,[]):
            a,c=bounds[i],bounds[j]
            if a[0]>c[2]+2.01 or c[0]>a[2]+2.01 or a[1]>c[3]+2.01 or c[1]>a[3]+2.01:continue
            below[i].append(j);above[j].append(i);patches[i,j]=_fa35_clip(polys[i],polys[j])
    def margin(i,changed=None,polygon=None,centre=None):
        if not int(records[i]['level']):return 7.5
        points=[]
        for j in below[i]:
            if changed==j:part=_fa35_clip(polys[i],polygon)
            elif changed==i:part=_fa35_clip(polygon,polys[j])
            else:part=patches[i,j]
            points.extend(part)
        return _fa35_margin(centre if centre is not None else records[i]['center'][:2],points)
    margins=[margin(i) for i in range(len(records))];initial=sum(v<-1e-7 for v in margins);repairs=[]
    moves=[]
    for step in range(1,9):
        distance=step*.25
        for du,dv in ((distance,0),(-distance,0),(0,distance),(0,-distance)):moves.append((du,dv))
    # Work upwards so each accepted support remains valid on the final bed.
    targets=sorted((i for i,m in enumerate(margins) if -2.00001<=m<-1e-7),key=lambda i:int(records[i]['level']))
    for target in targets:
        if margins[target]>=.01:continue
        contributors=[j for j in below[target] if patches[target,j]]
        found=False
        for du,dv in moves:
            if found:break
            for j in contributors:
                b=records[j];c,s=math.cos(b['angle']),math.sin(b['angle']);dx,dy=c*du-s*dv,s*du+c*dv
                pp=[(x+dx,y+dy) for x,y in polys[j]];centre=[b['center'][0]+dx,b['center'][1]+dy]
                if math.hypot(centre[0]-support_origins[j][0],centre[1]-support_origins[j][1])>2.000001:continue
                if margin(target,j,pp)<.01:continue
                candidate=dict(b);candidate['center']=[centre[0],centre[1],b['center'][2]]
                shape=(c,s,b['size'][0]/2.,b['size'][1]/2.);collision=False
                for k in floors[int(b['level'])]:
                    if k==j:continue
                    q=records[k];other=(math.cos(q['angle']),math.sin(q['angle']),q['size'][0]/2.,q['size'][1]/2.)
                    pair=_fa35_constraints([other,shape],max(0.,clearance-1e-6))[0]
                    if _fa35_separation([q['center'][:2],centre],pair)[0]>1e-7:collision=True;break
                if collision or margin(j,j,pp,centre)<.01:continue
                affected=above[j]
                next_margins={i:margin(i,j,pp) for i in affected}
                if any(next_margins[i]<min(.01,margins[i])-1e-7 for i in affected):continue
                before=list(b['center'][:2]);b['center'][0:2]=centre;polys[j]=pp
                for k in below[j]:patches[j,k]=_fa35_clip(pp,polys[k])
                for i in affected:patches[i,j]=_fa35_clip(polys[i],pp)
                margins[j]=margin(j)
                for i,v in next_margins.items():margins[i]=v
                repairs.append(dict(id=b['id'],target=records[target]['id'],local_u_mm=du,local_v_mm=dv,
                                    distance_mm=math.hypot(centre[0]-before[0],centre[1]-before[1])))
                found=True;break
    return dict(outside_before=initial,outside_after=sum(v<-1e-7 for v in margins),
                outside_ids=[records[i]['id'] for i,v in enumerate(margins) if v<-1e-7],
                zero_contact_ids=[records[i]['id'] for i,v in enumerate(margins) if v<=-1e8],
                minimum_com_margin_mm=min(margins,default=0.),repairs=repairs,
                full_load_equilibrium_verified=False)

def resolve_flat_layers(records, courses=None, clearance=1.):
    """Mutate XY only; keep angle, ID, list order, count and course order exact.

    Resolve only floors containing physical overlap. Each active floor uses
    symmetric minimum-axis translations with its original centroid fixed.
    No bricks are culled and no geometry/layout generator is called here.
    """
    clearance=float(clearance)
    if not math.isfinite(clearance) or clearance<0:raise ValueError('Use finite nonnegative brick clearance.')
    all_original=[list(b['center'][:2]) for b in records];by_level={}
    for b in records:by_level.setdefault(int(b['level']),[]).append(b)
    moved=[];changed=[];remaining=[];total_initial=0;max_iterations=0
    for level,bricks in sorted(by_level.items()):
        original=[list(b['center'][:2]) for b in bricks];xy=[list(p) for p in original]
        shapes=[(math.cos(b['angle']),math.sin(b['angle']),b['size'][0]/2.,b['size'][1]/2.) for b in bricks]
        physical=_fa35_constraints(shapes,0.)
        initial=sum(_fa35_separation(xy,p)[0]>1e-7 for p in physical)
        total_initial+=initial
        if not initial:continue
        _fa35_stagger_rows(bricks,xy,clearance)
        pairs=_fa35_constraints(shapes,clearance+1e-5)
        centroid=[sum(p[k] for p in original)/len(original) for k in (0,1)]
        iterations=0
        for iteration in range(320):
            maximum=0.
            sequence=pairs if not iteration%2 else reversed(pairs)
            for pair in sequence:
                depth,ux,uy=_fa35_separation(xy,pair)
                maximum=max(maximum,depth)
                if depth>1e-8:
                    i,j,_=pair;shift=depth*.5005
                    xy[i][0]+=shift*ux;xy[i][1]+=shift*uy
                    xy[j][0]-=shift*ux;xy[j][1]-=shift*uy
            iterations=iteration+1
            if maximum<1e-7:break
        # Remove numerical floor drift without changing relative separations.
        delta=[sum(p[k] for p in xy)/len(xy)-centroid[k] for k in (0,1)]
        for i,(b,p) in enumerate(zip(bricks,xy)):
            b['center'][0]=p[0]-delta[0];b['center'][1]=p[1]-delta[1]
            distance=math.hypot(b['center'][0]-original[i][0],b['center'][1]-original[i][1])
            if distance>1e-7:moved.append(dict(id=b['id'],level=level,distance_mm=distance))
        final_xy=[b['center'][:2] for b in bricks]
        for pair in physical:
            if _fa35_separation(final_xy,pair)[0]>1e-6:
                i,j,_=pair;remaining.append([bricks[i]['id'],bricks[j]['id']])
        changed.append(level+1);max_iterations=max(max_iterations,iterations)
    support=_fa35_repair_below(records,clearance)
    moved=[]
    for b,old in zip(records,all_original):
        distance=math.hypot(b['center'][0]-old[0],b['center'][1]-old[1])
        if distance>1e-7:moved.append(dict(id=b['id'],level=int(b['level']),distance_mm=distance))
    return dict(method='local_symmetric_minimum_axis_translation',
        original_overlap_pairs=total_initial,remaining_overlap_pairs=remaining,
        changed_courses=changed,moved_bricks=len(moved),
        maximum_xy_move_mm=max((q['distance_mm'] for q in moved),default=0.),
        rms_xy_move_mm=math.sqrt(sum(q['distance_mm']**2 for q in moved)/len(records)) if records else 0.,
        clearance_mm=clearance,maximum_iterations=max_iterations,
        angles_ids_order_counts_and_z_preserved=True,
        individual_moves=moved,support_repair=support,contact_and_load_audits_revalidated=False)


def _bm34_apply(result,upright_mode,clearance=1.):
    """Keep True exact; flatten and locally separate the False variant."""
    if upright_mode:return result
    import copy
    r=copy.deepcopy(result)
    for b in r['records']:
        b['_fa35_source_upright']=b['size'][2]==15.
        b['size']=[32.,15.,10.]
        b['center'][2]=(int(b['level'])+.5)*10.
        b['pose']='B1';b['brick_type']='flat'
    for i,row in enumerate(r['layer_info']):
        row.update(bed_z=i*10.,height=10.,top_z=(i+1)*10.)
    r['height']=len(r['courses'])*10.
    stats=resolve_flat_layers(r['records'],r['courses'],clearance=clearance)
    for b in r['records']:b.pop('_fa35_source_upright',None)
    stats.pop('angles_ids_order_counts_and_z_preserved',None)
    stats['angles_ids_counts_and_z_preserved']=True
    # Preserve the established assembly rule at the corrected coordinates.
    r=_outside_in(r)
    r['mode_info']=dict(upright_mode=False,brick_size=[32.,15.,10.],
        all_courses_height=10.,height=r['height'],xy_repacked=True,
        angles_ids_counts_and_z_preserved=True,
        placement_rule_preserved=True,order_recomputed_after_repacking=True,
        canonical_layout='upright_mode=True',
        auto_adjustment=stats,same_course_overlap_pairs=stats['remaining_overlap_pairs'],
        contact_and_load_audits_revalidated=False)
    return r

def _bm34_flat_output(result,data,iteration):
    import json
    payload=json.loads(data)
    payload.update(records=result['records'],order=result['order'],height=result['height'],
        layer_info=result['layer_info'],mode_info=result['mode_info'],
        placement_rule=result['placement_rule'])
    for name in ('merge_info','joint_info','hourglass_info','contact_audit'):
        payload.pop(name,None)
    if 'bond_info' in payload:
        payload['bond_info']['even_size']=[32.,15.,10.]
        payload['bond_info']['odd_size']=[32.,15.,10.]
    m=result['mode_info'];a=m['auto_adjustment'];pairs=m['same_course_overlap_pairs']
    support=a.get('support_repair',{})
    issues=['OVERLAP: %s <-> %s'%(p,q) for p,q in pairs]
    issues+=['BEARING REVIEW: '+ident for ident in support.get('outside_ids',[])]
    report=('ITERATION %02d / ALL FLAT + AUTOMATIC SPACING\n'
        'upright_mode=False: every brick is 32 x 15 x 10 mm.\n'
        '%d bricks / %d courses / %.1f mm total height.\n'
        'Original %d overlap pairs; remaining %d.\n'
        'Moved %d bricks locally; maximum XY move %.3f mm.\n'
        'Corrected courses target %.3f mm clearance; no brick is deleted or rotated.\n'
        'IDs and counts are retained; placement order is updated outside to inside at the corrected XY positions.\n'
        'Individual centre-of-mass outside direct support: %d bricks. See issues.\n'
        'This resolves brick overlap. It does not certify bearing or full-stack load stability.'
        %(iteration,len(result['records']),len(result['courses']),result['height'],
          a['original_overlap_pairs'],len(pairs),a['moved_bricks'],a['maximum_xy_move_mm'],a['clearance_mm'],support.get('outside_after',0)))
    return report,json.dumps(payload,separators=(',',':')),issues


import json,Rhino,Grasshopper as gh
geometry=[];spine=[];frames=[];issues=[];report='';data='';order=[];contacts=[];course_info=[]
try:
    if Rhino.RhinoDoc.ActiveDoc.ModelUnitSystem!=Rhino.UnitSystem.Millimeters:raise ValueError('Use Rhino millimetres.')
    result=generate(num_layers=int(num_layers),even_to_odd=float(even_to_odd),odd_to_even=float(odd_to_even),heading_deg=float(heading_deg),closing_gap=float(closing_gap),gap=float(gap),odd_gap=float(odd_gap),even_columns=int(even_columns),rot_step=float(rot_step))
    result=_outside_in(result)
    result=_bm34_apply(result,bool(upright_mode),float(gap))
    geometry,spine,frames,issues,report,data,order,contacts,course_info=preview_and_data(result,int(display_mode),0)
    ghenv.Component.Message='01 | %d BRICKS | OUT > IN'%len(result['records'])
    if not bool(upright_mode):
        report,data,issues=_bm34_flat_output(result,data,1)
        ghenv.Component.Message='AUTO FLAT | %d BRICKS'%len(result['records'])
        unresolved=result['mode_info']['same_course_overlap_pairs']
        bearing=result['mode_info']['auto_adjustment'].get('support_repair',{}).get('outside_ids',[])
        if unresolved:
            ghenv.Component.AddRuntimeMessage(gh.Kernel.GH_RuntimeMessageLevel.Warning,'Auto flat: %d unresolved brick overlap pairs. See issues/report.'%len(unresolved))
        if bearing:
            ghenv.Component.Message='AUTO FLAT | %d BEARING WARNINGS'%len(bearing)
            ghenv.Component.AddRuntimeMessage(gh.Kernel.GH_RuntimeMessageLevel.Warning,'Auto flat: %d bricks have their own centre of mass outside direct support. Spacing is adjusted; bearing needs review. See issues/report.'%len(bearing))
except Exception as exc:
    data=json.dumps(dict(error=str(exc)));ghenv.Component.AddRuntimeMessage(gh.Kernel.GH_RuntimeMessageLevel.Error,str(exc))
# ---------- end plan_2_even_upright ----------

# ---- group: Data 2
data = Data(plan_2_even_upright.data)

# ----
# Measure work object
panel = Panel("192.168.10.10")
point = ValueList({"origin", "xaxis", "xypoint"}, selected="xypoint")
capture = Button()
capture_wobj = CaptureWobj(robot_ip=panel, point_name=point, capture=capture)  # -> wobj_origin, wobj_xaxis, wobj_xypoint, info
# ---------- capture_wobj: Python ----------
"""
Capture the 3 points that define the work object (robot base) plane.

Jog the TCP to a point, pick its name (origin / xaxis / xypoint) and press capture.
The TCP position (robot base frame, mm) is saved to wobj_calibration.json next to
this .ghx file, so the points survive closing Grasshopper.
"""
import os
import sys
import json
import time

import scriptcontext as sc
import Rhino.Geometry as rg

NAMES = ["origin", "xaxis", "xypoint"]

gh_dir = os.path.dirname(ghenv.Component.OnPingDocument().FilePath)
src_dir = os.path.join(gh_dir, "src")
if src_dir not in sys.path:
    sys.path.append(src_dir)
import simple_comm as com

path = os.path.join(gh_dir, "wobj_calibration.json")

data = {}
if os.path.exists(path):
    with open(path) as f:
        data = json.load(f)

# keep the last status in sticky, so the message survives the button being released
status_key = "capture_status_" + str(ghenv.Component.InstanceGuid)

if capture:
    if point_name not in NAMES:
        sc.sticky[status_key] = "pick origin / xaxis / xypoint"
    else:
        try:
            x, y, z = list(com.listen_to_robot(robot_ip)["pose"])[:3]  # metres, robot base frame
            data[point_name] = [round(x * 1000, 2), round(y * 1000, 2), round(z * 1000, 2)]  # -> mm
            with open(path, "w") as f:
                json.dump(data, f, indent=2)
            sc.sticky[status_key] = "{} captured {}".format(point_name, time.strftime("%H:%M:%S"))
        except Exception as e:
            print(e)
            sc.sticky[status_key] = "robot not reachable"

ghenv.Component.Message = sc.sticky.get(status_key, "")

def pt(name):
    return rg.Point3d(*data[name]) if name in data else None

wobj_origin, wobj_xaxis, wobj_xypoint = pt("origin"), pt("xaxis"), pt("xypoint")
info = json.dumps(data, indent=2)
# ---------- end capture_wobj ----------
wobj_calibration = Panel(capture_wobj.info)

data_robot_frames = DATAROBOT(data=data)  # -> way_planes, brick_heights, brick_widths, part_ids
# ---------- data_robot_frames: Python ----------
# r: compas
# venv: mas-2627
"""Convert ordered design data to COMPAS TCP frames. No structural analysis."""
import json,math
from compas.geometry import Frame
import Grasshopper as gh

def convert_data(payload):
    state=json.loads(str(payload));records=state.get('records',[]);order=state.get('order',[])
    if not isinstance(records,list) or not records:raise ValueError(state.get('error','No brick data. Connect Data 1 OR Data 2.'))
    if not isinstance(order,list):raise ValueError('Brick order must be a list.')
    by_id={b['id']:b for b in records}
    if len(by_id)!=len(records) or len(order)!=len(records) or len(set(order))!=len(order) or set(order)!=set(by_id):raise ValueError('Order must contain every brick ID exactly once.')
    ff=[];hh=[];ww=[];ids=[]
    for ident in order:
        b=by_id[ident];x,y,z=[float(v) for v in b['center']];length,width,height=[float(v) for v in b['size']];a=float(b['angle'])
        if not all(math.isfinite(v) for v in (x,y,z,length,width,height,a)) or min(length,width,height)<=0:raise ValueError('%s: invalid brick dimensions or position.'%ident)
        if abs(length-32.)>1e-6:raise ValueError('%s: downstream code expects 32 mm brick length.'%ident)
        c,s=math.cos(a),math.sin(a)
        ff.append(Frame([x,y,z+height/2],[-c,-s,0],[-s,c,0]));hh.append(height);ww.append(width);ids.append(ident)
    return ff,hh,ww,ids

way_planes=[];brick_heights=[];brick_widths=[];part_ids=[]
try:
    if ghenv.Component.Params.Input[0].VolatileData.DataCount!=1:raise ValueError('Connect one design payload: Data 1 OR Data 2.')
    ff,hh,ww,ids=convert_data(data)
    way_planes=ff;brick_heights=hh;brick_widths=ww;part_ids=ids
    ghenv.Component.Message='FRAMES | %d BRICKS'%len(ids)
except Exception as exc:
    ghenv.Component.Message='INPUT ERROR';ghenv.Component.AddRuntimeMessage(gh.Kernel.GH_RuntimeMessageLevel.Error,str(exc))
# ---------- end data_robot_frames ----------
fine_adjust_z_mm = Slider(-6.3, range=-10..10)
# Transform from Rhino to Robot Space
transform = Python3Script(
    way_planes=data_robot_frames.way_planes,
    wobj_origin=capture_wobj.wobj_origin,
    wobj_xaxis=capture_wobj.wobj_xaxis,
    wobj_xypoint=capture_wobj.wobj_xypoint,
    z_safe_margin=fine_adjust_z_mm)  # -> out, transformed_frames; inputs way_planes: list, wobj_origin: Point3d, wobj_xaxis: Point3d, wobj_xypoint: Point3d, z_safe_margin: Double
# ---------- transform: Python ----------
from compas.geometry import Frame, Transformation, Translation, Vector
import math as m

#in this step we transform our way planes to robot space
#the rhino co-ordinate system is rather abstract in the physical world
#the robot base plane assumed the base frame of robot is the origin
#but rhino does not know that
#thus we transform things from our design space(Rhino World XY) to Robot Base Plane that we measure

def set_robot_base(origin, xaxis, xypoint):
    """
    set a base plane representing the robot working object plane
    """
    robot_base = Frame(origin, xaxis - origin, xypoint - origin)
    robot_base = robot_base.rotated(m.radians(90), robot_base.zaxis, robot_base.point)
    robot_base = robot_base.translated(robot_base.xaxis * 250 + robot_base.yaxis * -150)
    print (robot_base)
    return (robot_base)

def rhino_to_robot_space(rhino_plane,robot_base_plane):
    """
    Transform the objects from Rhino world XY plane to robot work object plane
    """
    T_matrix = Transformation.from_frame_to_frame(Frame.worldXY(), robot_base_plane)
    robot_plane = rhino_plane.transformed(T_matrix)
    return robot_plane

def set_z_safe_margin(planes_to_adjust, safety_margin):
    adjusted = []
    T = Translation.from_vector(Vector(0, 0, safety_margin))
    for f in planes_to_adjust:
        adjusted.append(f.transformed(T))
    return adjusted

# ===== Robot base is set =====
robot_base =  set_robot_base(wobj_origin, wobj_xaxis, wobj_xypoint)

# ===== Set safety margin for Z height ======
safe_planes = set_z_safe_margin(way_planes, z_safe_margin)

# ===== Transforming the rhino planes into robot planes =====
transformed_frames = []
for plane in safe_planes: 
    transformed_frames.append(rhino_to_robot_space(plane, robot_base))
# ---------- end transform ----------

# ----
# Measure top left-most position of array
point_2 = ValueList({"origin", "xaxis", "xypoint"}, selected="xypoint")
capture_2 = Button()
capture_pick = CapturePick(robot_ip=panel, point_name=point_2, capture=capture_2)  # -> origin, xaxis_pt, xy_pt, info
# ---------- capture_pick: Python ----------
"""
Capture the 3 points that define the pick frame at the brick pick-up location.

Jog the TCP to a point, pick its name (origin / xaxis / xypoint) and press capture.
The TCP position (robot base frame, mm) is saved to pick_calibration.json next to
this .ghx file, so the points survive closing Grasshopper.
"""
import os
import sys
import json
import time

import scriptcontext as sc
import Rhino.Geometry as rg

NAMES = ["origin", "xaxis", "xypoint"]

gh_dir = os.path.dirname(ghenv.Component.OnPingDocument().FilePath)
src_dir = os.path.join(gh_dir, "src")
if src_dir not in sys.path:
    sys.path.append(src_dir)
import simple_comm as com

path = os.path.join(gh_dir, "array_calibration.json")

data = {}
if os.path.exists(path):
    with open(path) as f:
        data = json.load(f)

# keep the last status in sticky, so the message survives the button being released
status_key = "capture_status_" + str(ghenv.Component.InstanceGuid)

if capture:
    if point_name not in NAMES:
        sc.sticky[status_key] = "pick origin / xaxis / xypoint"
    else:
        try:
            x, y, z = list(com.listen_to_robot(robot_ip)["pose"])[:3]  # metres, robot base frame
            data[point_name] = [round(x * 1000, 2), round(y * 1000, 2), round(z * 1000, 2)]  # -> mm
            with open(path, "w") as f:
                json.dump(data, f, indent=2)
            sc.sticky[status_key] = "{} captured {}".format(point_name, time.strftime("%H:%M:%S"))
        except Exception as e:
            print(e)
            sc.sticky[status_key] = "robot not reachable"

ghenv.Component.Message = sc.sticky.get(status_key, "")

def pt(name):
    return rg.Point3d(*data[name]) if name in data else None

origin, xaxis_pt, xy_pt = pt("origin"), pt("xaxis"), pt("xypoint")
info = json.dumps(data, indent=2)
# ---------- end capture_pick ----------
pick_calibration = Panel(capture_pick.info)
py3 = Python3Script(origin=capture_pick.origin, xaxis_pt=capture_pick.xaxis_pt, xy_pt=capture_pick.xy_pt)  # -> out, array_frames, viz_frames, array_starts; inputs origin: Point3d, xaxis_pt: Point3d, xy_pt: Point3d
# ---------- py3: Python ----------
from compas.geometry import Frame, Point
from compas.geometry import Rotation

import math as m

from compas_rhino.conversions import point_to_compas
from compas_rhino.conversions import frame_to_rhino

origin = point_to_compas(origin)
xaxis_pt = point_to_compas(xaxis_pt)
xy_pt = point_to_compas(xy_pt)
array_depth = 3
array_rows = 15
array_columns = 7
brick_height = 9.8
column_distance = 32.1
row_distance = 15

# define array start
array_start = Frame(origin, xaxis_pt - origin, xy_pt - origin)
array_start = array_start.translated(array_start.zaxis * 3.5)
# array_start = array_start.rotated(m.radians(-90), array_start.zaxis, array_start.point)

array_frames = []
array_starts = []
viz_frames = []

for k in range (array_depth):
    
    for j in range(array_rows):
            
            for i in range(array_columns):
                if k == 0:
                    array_start_copy = array_start.copy()
                    array_start_copy.translate(array_start.xaxis * (column_distance * i))
                    array_start_copy.translate(array_start.yaxis * (row_distance * j))
                    array_starts.append(array_start_copy)


                array_copy = array_start.copy()
                array_copy.translate(array_start.zaxis * (brick_height * k))
                array_copy.translate(array_start.xaxis * (column_distance * i))
                array_copy.translate(array_start.yaxis * (row_distance * j))

                if (j+1) % 15 == 0:
                    array_copy = array_start.copy()
                    array_copy.translate(array_start.zaxis * (brick_height * k))
                    array_copy.translate(array_start.xaxis * (column_distance * i))
                    array_copy.translate(array_start.yaxis * (row_distance * j))
                    array_copy.rotated(m.radians(180), array_copy.zaxis, array_copy.point)
                

                array_frames.append(array_copy)

for frame in array_frames:
    new_frame = frame_to_rhino(frame)
    viz_frames.append(new_frame)
# ---------- end py3 ----------

# ----
# Measure pick up location
point_3 = ValueList({"origin", "xaxis", "xypoint"}, selected="xypoint")
capture_3 = Button()
capture_pick_2 = CapturePick(robot_ip=panel, point_name=point_3, capture=capture_3)  # -> origin, xaxis_pt, xy_pt, info
# ---------- capture_pick_2: Python ----------
"""
Capture the 3 points that define the pick frame at the brick pick-up location.

Jog the TCP to a point, pick its name (origin / xaxis / xypoint) and press capture.
The TCP position (robot base frame, mm) is saved to pick_calibration.json next to
this .ghx file, so the points survive closing Grasshopper.
"""
import os
import sys
import json
import time

import scriptcontext as sc
import Rhino.Geometry as rg

NAMES = ["origin", "xaxis", "xypoint"]

gh_dir = os.path.dirname(ghenv.Component.OnPingDocument().FilePath)
src_dir = os.path.join(gh_dir, "src")
if src_dir not in sys.path:
    sys.path.append(src_dir)
import simple_comm as com

path = os.path.join(gh_dir, "pick_calibration.json")

data = {}
if os.path.exists(path):
    with open(path) as f:
        data = json.load(f)

# keep the last status in sticky, so the message survives the button being released
status_key = "capture_status_" + str(ghenv.Component.InstanceGuid)

if capture:
    if point_name not in NAMES:
        sc.sticky[status_key] = "pick origin / xaxis / xypoint"
    else:
        try:
            x, y, z = list(com.listen_to_robot(robot_ip)["pose"])[:3]  # metres, robot base frame
            data[point_name] = [round(x * 1000, 2), round(y * 1000, 2), round(z * 1000, 2)]  # -> mm
            with open(path, "w") as f:
                json.dump(data, f, indent=2)
            sc.sticky[status_key] = "{} captured {}".format(point_name, time.strftime("%H:%M:%S"))
        except Exception as e:
            print(e)
            sc.sticky[status_key] = "robot not reachable"

ghenv.Component.Message = sc.sticky.get(status_key, "")

def pt(name):
    return rg.Point3d(*data[name]) if name in data else None

origin, xaxis_pt, xy_pt = pt("origin"), pt("xaxis"), pt("xypoint")
info = json.dumps(data, indent=2)
# ---------- end capture_pick_2 ----------
pick_calibration_2 = Panel(capture_pick_2.info)
py3_2 = Python3Script(origin=capture_pick_2.origin, xaxis_pt=capture_pick_2.xaxis_pt, xy_pt=capture_pick_2.xy_pt)  # -> out, pick_frame; inputs origin: Point3d, xaxis_pt: Point3d, xy_pt: Point3d
# ---------- py3_2: Python ----------
from compas.geometry import Frame, Point
from compas.geometry import Rotation

import math as m

from compas_rhino.conversions import point_to_compas

origin = point_to_compas(origin)
xaxis_pt = point_to_compas(xaxis_pt)
xy_pt = point_to_compas(xy_pt)
brick_offset = -9.8

#define pick frame
pick_frame = Frame(origin, xaxis_pt - origin, xy_pt - origin)
# pick_frame = pick_frame.rotated(m.pi/2, pick_frame.zaxis, pick_frame.point)
pick_frame = pick_frame.translated(pick_frame.zaxis * brick_offset)
# pick_frame = pick_frame.translated(pick_frame.xaxis * 1.5)
pick_frame = pick_frame.translated(pick_frame.yaxis * -.5)
# pick_frame = pick_frame.rotated(m.radians(10), pick_frame.zaxis, pick_frame.point)
# ---------- end py3_2 ----------
compas_draw = COMPASDraw(cg=py3_2.pick_frame)  # -> rg
#   port cg: The COMPAS geometry or datastructure to be drawn.
#   port rg: The Rhino geometry object.
# ---------- compas_draw: Python ----------
# r: compas>=2.14.1
"""
Draws COMPAS geometry in Grasshopper.
"""

from typing import Any

import Grasshopper

from compas.scene import SceneObject


class CompasToRhinoGeometry(Grasshopper.Kernel.GH_ScriptInstance):
    def RunScript(self, cg):
        if not cg:
            return None

        return SceneObject(item=cg).draw()
# ---------- end compas_draw ----------

compas_draw_2 = COMPASDraw(cg=transform.transformed_frames)  # -> rg; same code as compas_draw

# ----
# Measure and set TCP
panel_2 = Panel("10.16")
pt = ConstructPoint(XCoordinate=panel_2, YCoordinate="-42.18", ZCoordinate="190.36")

number_slider = Slider(1, range=0..1)
number_slider_2 = Slider(1, range=0..1)
compas_draw_3 = COMPASDraw(cg=[transform.transformed_frames, py3.array_frames])  # -> rg; same code as compas_draw
pln = Plane(py3.viz_frames)
# Convert Planes to URScript
number_slider_3 = Slider(7, range=0..420)
compas = Python3Script(
    way_frames=transform.transformed_frames,
    tcp_measured=pt,
    acceleration=number_slider,
    velocity=number_slider_2,
    pick_frame=py3_2.pick_frame,
    array_frames=py3.array_frames,
    array_starts=py3.array_starts)  # -> out, vis_frames, vis_planes, script; inputs way_frames: list, tcp_measured: Point3d, acceleration: Double, velocity: Double, array_frames: list, array_starts: list
# ---------- compas: Python ----------
from imp import reload
import sys
import os

from itertools import cycle

#get current file path
path = ghenv.Component.OnPingDocument().FilePath
#get parent directory of the parent directory
parentdir = os.path.dirname(path)
#get src folder which contains classes
dire = os.path.join(parentdir,'src')

sys.path.append(dire)

import simple_ur_script as ur
reload(ur)

import utils 
reload(utils)

import simple_comm as com
reload(com)

import compas.geometry as cg
import math as m

# ===== Set global constants =======

IO = 4 # Global constant
SAFE_DIST = 50
BLEND_RAD = 10
BRICK_COUNT = 3

# =================================

# script to activate vacuum
# script += ur.set_digital_out(IO, signal=True)
# script += ur.sleep(20)
# script += ur.set_digital_out(IO, signal=False)

script = "" #create empty string


def pickup_brick(script, pick_up_frame, current_array, array_start):
    frames = []
    
    # Set frame locs
    safe_frame = pick_up_frame.translated(pick_up_frame.zaxis * -SAFE_DIST)
    very_safe_frame = pick_up_frame.translated(pick_up_frame.zaxis * -150)
    drop_frame = pick_up_frame.translated(pick_up_frame.yaxis * 30 + pick_up_frame.xaxis * 15)
    safe_array = array_start.translated(array_start.zaxis * -150)
    brick_bump = pick_up_frame.translated(pick_up_frame.xaxis * 16 + pick_up_frame.zaxis * 5)
    brick_bump_safe = brick_bump.translated(brick_bump.xaxis * 15)
    

    # Move to safe frame
    script += ur.move_j([-2.13, -1.73, 1.84, -1.75, -1.63, 0.06], acceleration, velocity)
    # Move to array start
    script += ur.move_l(safe_array, acceleration, velocity)
    script += ur.move_l(current_array, acceleration, velocity)
    script += ur.set_digital_out(IO, signal=True)
    script += ur.sleep(1)
    script += ur.move_l(safe_array, acceleration, velocity)
    script += ur.move_j([-2.13, -1.73, 1.84, -1.75, -1.63, 0.06], acceleration, velocity)
    # Move to drop frame
    script += ur.move_l(very_safe_frame, acceleration, velocity)
    script += ur.move_l(drop_frame, acceleration, velocity)
    script += ur.sleep(1)
    script += ur.set_digital_out(IO, signal=False)
    # Bump dat shit
    script += ur.move_l(safe_frame, acceleration, velocity)
    script += ur.move_l(brick_bump_safe, acceleration, velocity)
    script += ur.move_l(brick_bump, acceleration, velocity)
    script += ur.move_l(brick_bump_safe, acceleration, velocity)
    script += ur.move_l(safe_frame, acceleration, velocity)
    # Move to pick location
    script += ur.move_l(safe_frame, acceleration, velocity)
    script += ur.move_l(pick_up_frame, acceleration/4, velocity/4)
    # Activate gripper
    script += ur.set_digital_out(IO, signal=True)
    script += ur.sleep(1)
    # Move back to safe plane
    script += ur.move_l(very_safe_frame, acceleration, velocity)
    script += ur.move_j([-2.13, -1.73, 1.84, -1.75, -1.63, 0.06], acceleration, velocity)
    return script, frames


def place_brick(script, place_frame):
    frames = []
    
    # Safe frame for placing
    safe_frame = place_frame.translated(place_frame.zaxis * -SAFE_DIST)
    # Add to the path: go to the safe plane
    script += ur.move_l_blend(safe_frame, acceleration, velocity, BLEND_RAD)
    # Add to the path: go to the place plane
    script += ur.move_l_blend(place_frame, acceleration/4, velocity/4, BLEND_RAD)
    # Add to the path: turn off the vacuum and wait 1 second (hold the brick)
    script += ur.sleep(1)
    script += ur.set_digital_out(IO, signal=False)
    # Add to the path: go back to the safe plane
    script += ur.move_l_blend(safe_frame, acceleration/4, velocity/4, BLEND_RAD)
    return script,frames


#if value given for tcp measured, then add line to script, otherwise it will take current tcp from robot
if tcp_measured is not None:
    script += ur.set_tcp_by_angles(tcp_measured.X, tcp_measured.Y, tcp_measured.Z, m.radians(0.0),m.radians(0.0),m.radians(0))


vis_frames = []

# Generate pick and place sequence
for i in range(len(way_frames)):
    script, _ = pickup_brick(script, pick_frame, array_frames[i], array_starts[i % len(array_starts)])
    script, _ = place_brick(script, way_frames[i])


# Format the script to make it sendable
script += ur.move_j([-2.13, -1.73, 1.84, -1.75, -1.63, 0.06], acceleration, velocity)
script = com.concatenate_script(script)


# Visualize
from compas_rhino import conversions
import Rhino.Geometry as rg

vis_planes = [conversions.frame_to_rhino(frame) for frame in vis_frames]
# ---------- end compas ----------
split = SplitList(List=pln, Index=Slider(162, range=0..420))  # -> ListA, ListB
pline = PolyLine(Vertices=split.ListA, Closed=False)
points = PointList(Points=split.ListA, Size=number_slider_3)
compas_draw_4 = COMPASDraw()  # -> rg; same code as compas_draw
py3_3 = Python3Script()  # -> out, a
# ---------- py3_3: Python ----------
"""
3. CONVERT FRAMES TO URSCRIPT

Generate the robotic pick-and-place sequence using
the functions defined in robot_operations.py.

Inputs:
    way_frames    : List of COMPAS Frames
    pick_frame    : COMPAS Frame
    acceleration  : Float
    velocity      : Float
    IO            : Integer
    tcp_measured  : Rhino Point3d (optional)

Outputs:
    script        : URScript string
    out           : Debug information
    vis_frames
    vis_planes 
"""

# ============================================================
# IMPORTS
# ============================================================

import sys
import os
import compas.geometry as cg
import Rhino.Geometry as rg
import math as m

from compas_rhino import conversions
from compas_rhino.conversions import frame_to_rhino
from imp import reload

# ============================================================
# LOAD MODULES FROM SRC
# ============================================================

#get current file path
path = ghenv.Component.OnPingDocument().FilePath
#get parent directory of the parent directory
parentdir = os.path.dirname(path)
#get src folder which contains classes
dire = os.path.join(parentdir,'src')
sys.path.append(dire)

#import src .py files
import simple_ur_script as ur
import utils 
import simple_comm as com
import robot_operations as robot

reload(ur)
reload(utils)
reload(com)
reload(robot)

# ============================================================
# FUNCTIONS
# ============================================================

def unwrap_frame(item):

    while hasattr(item, "Value"):
        item = item.Value

    if not isinstance(item, cg.Frame):
        raise TypeError(
            "Expected COMPAS Frame, got {}".format(
                type(item)
            )
        )

    return item

# ============================================================
# CONVERT GRASSHOPPER INPUTS TO COMPAS FRAMES
# ============================================================

pick_frame = unwrap_frame(pick_frame_1)

way_frames = [
    unwrap_frame(frame)
    for frame in way_frames
]

if len(feeder_ids) != len(way_frames):
    raise ValueError(
        "Number of feeder IDs must match number of placement frames."
    )

if len(brick_types) != len(way_frames):
    raise ValueError(
        "Brick types and placement frames must have the same length."
    )

# ============================================================
# INITIALIZE SCRIPT
# ============================================================

script = ""

# ============================================================
# SET TCP
# ============================================================

#if value given for tcp measured, then add line to script, otherwise it will take current tcp from robot
if tcp_measured is not None:
    script += ur.set_tcp_by_angles(
        tcp_measured.X, 
        tcp_measured.Y, 
        tcp_measured.Z, 
        m.radians(0.0),
        m.radians(0.0),
        m.radians(0.0)
    )




# ============================================================
# GENERATE PICK AND PLACE SEQUENCE — PALLETIZED PICKUP
# ============================================================

vis_frames = []
pallet_pick_frames = []

# Pallet dimensions
x_bricks = 3
y_bricks = 2
z_bricks = 10

bricks_per_layer = x_bricks * y_bricks
n_layers = z_bricks

brick_length = 32
brick_width = 15
brick_height = 10


for n, place_frame in enumerate(way_frames):

    # ========================================================
    # PALLET INDEX
    # ========================================================

    # Layer: 0, 1, 2...
    layer = n // bricks_per_layer

    # Position within the current layer
    index_in_layer = n % bricks_per_layer

    # X index: 0, 1, 2... x_bricks-1
    i = index_in_layer % x_bricks

    # Y index: 0, 1, 2... y_bricks-1
    j = index_in_layer // x_bricks

    # ========================================================
    # CALCULATE PICKUP POSITION
    # ========================================================

    dx = i * brick_length
    dy = j * brick_width
    dz = layer * brick_height

    # Translate the calibrated pickup frame in global XYZ
    current_pick_frame = pick_frame.translated(
    pick_frame.xaxis * dx
    + pick_frame.yaxis * dy
    + pick_frame.zaxis * dz
    )

    pallet_pick_frames.append(current_pick_frame)

    # ========================================================
    # PICKUP
    # ========================================================

    script, pickup_frames = robot.pickup_brick(
        script,
        current_pick_frame,
        acceleration,
        velocity,
        IO
    )

    # ========================================================
    # PLACEMENT
    # ========================================================

    script, placement_frames = robot.place_brick(
            script,
            place_frame,
            acceleration,
            velocity,
            IO
        )


    # Pause after every layer (related to feeder size)

    if (i + 1) % (bricks_per_layer * n_layers) == 0:
        # popup_script = ur.popup(">:0 gimme BRICK", "ATTENTION", blocking=True)
        script += '\tpopup(">:0 PALLET EMPTY, REFILL ME PLEASE!", title="ATTENTION", blocking=True)\n'



# ============================================================
# RETURN ROBOT TO HOME POSITION
# ============================================================

script += ur.move_j(
    robot.HOME_JOINTS,
    acceleration,
    velocity
)



# ============================================================
# FORMAT URSCRIPT
# ============================================================

script = com.concatenate_script(script)


# ============================================================
# DEBUG OUTPUT
# ============================================================

out = (
    "URScript generated successfully.\n"
    + "Bricks: " + str(len(way_frames)) + "\n"
    + "Acceleration: " + str(acceleration) + "\n"
    + "Velocity: " + str(velocity) + "\n"
    + "Digital IO: " + str(IO)
)


# ============================================================
# PREVIEW OUTPUTS
# ============================================================

vis_planes = [frame_to_rhino(frame) for frame in vis_frames]
# ---------- end py3_3 ----------
points_2 = PointList(Size=Slider(0, range=0..100))
panel_3 = Panel(compas.script)
# Send to Robot!
compas_2 = Python3Script()  # -> out, vis_frames, vis_planes, script; inputs way_frames: list, tcp_measured: Point3d, acceleration: Double, velocity: Double, array_starts: list, array_frames: list
# ---------- compas_2: Python ----------
from imp import reload
import sys
import os

#get current file path
path = ghenv.Component.OnPingDocument().FilePath
#get parent directory of the parent directory
parentdir = os.path.dirname(path)
#get src folder which contains classes
dire = os.path.join(parentdir,'src')

sys.path.append(dire)

import simple_ur_script as ur
reload(ur)

import utils 
reload(utils)

import simple_comm as com
reload(com)

import compas.geometry as cg
import math as m

# ===== Set global constants =======

IO = 4 # Global constant
SAFE_DIST = -150
BLEND_RAD = 10
BRICK_COUNT = 10

# =================================

# script to activate vacuum
# script += ur.set_digital_out(IO, signal=True)
# script += ur.sleep(20)
# script += ur.set_digital_out(IO, signal=False)

script = "" #create empty string


# def pickup_brick(script, pick_up_frame):
#     frames = []
    
#     # # Set frame locs
#     # safe_frame = pick_up_frame.translated(pick_up_frame.zaxis * -SAFE_DIST)
#     # drop_frame = pick_up_frame.translated(pick_up_frame.yaxis * 30 + pick_up_frame.xaxis * 15)
#     # safe_array = array_start.translated(array_start.zaxis * -SAFE_DIST)
#     # brick_bump = pick_up_frame.translated(pick_up_frame.xaxis * 18 + pick_up_frame.zaxis * 5)
#     # brick_bump_safe = brick_bump.translated(brick_bump.xaxis * 15)
    

#     # Move to safe frame
#     script += ur.move_j([-2.13, -1.73, 1.84, -1.75, -1.63, 0.06], acceleration, velocity)
#     # # Move to array start
#     # script += ur.move_l(safe_array, acceleration, velocity)
#     # script += ur.move_l(current_array, acceleration, velocity)
#     # script += ur.set_digital_out(IO, signal=True)
#     # script += ur.sleep(1)
#     # script += ur.move_l(safe_array, acceleration, velocity)
#     # script += ur.move_j([-2.13, -1.73, 1.84, -1.75, -1.63, 0.06], acceleration, velocity)
#     # # Move to drop frame
#     # script += ur.move_l(safe_frame, acceleration, velocity)
#     # script += ur.move_l(drop_frame, acceleration, velocity)
#     # script += ur.sleep(1)
#     # script += ur.set_digital_out(IO, signal=False)
#     # # Bump dat shit
#     # script += ur.move_l(safe_frame, acceleration, velocity)
#     # script += ur.move_l(brick_bump_safe, acceleration, velocity)
#     # script += ur.move_l(brick_bump, acceleration, velocity)
#     # script += ur.move_l(brick_bump_safe, acceleration, velocity)
#     # script += ur.move_l(safe_frame, acceleration, velocity)
#     # Move to pick location
#     # script += ur.move_l(safe_frame, acceleration, velocity)
#     script += ur.move_l(pick_up_frame, acceleration/4, velocity/4)
#     # Activate gripper
#     script += ur.set_digital_out(IO, signal=True)
#     script += ur.sleep(1)
#     # Move back to safe plane
#     # script += ur.move_l(safe_frame, acceleration, velocity)
#     script += ur.move_j([-2.13, -1.73, 1.84, -1.75, -1.63, 0.06], acceleration, velocity)
#     return script, frames


# def place_brick(script, place_frame):
#     frames = []
    
#     # Safe frame for placing
#     safe_frame = place_frame.translated(place_frame.zaxis * -SAFE_DIST)
#     # Add to the path: go to the safe plane
#     script += ur.move_l_blend(safe_frame, acceleration, velocity, BLEND_RAD)
#     # Add to the path: go to the place plane
#     script += ur.move_l_blend(place_frame, acceleration/4, velocity/4, BLEND_RAD)
#     # Add to the path: turn off the vacuum and wait 1 second (hold the brick)
#     script += ur.sleep(1)
#     script += ur.set_digital_out(IO, signal=False)
#     # Add to the path: go back to the safe plane
#     script += ur.move_l_blend(safe_frame, acceleration/4, velocity/4, BLEND_RAD)
#     return script,frames

def pickup_brick(script, pick_frame, acceleration, velocity, IO):

    frames = []

    safe_frame = pick_frame.translated(
        pick_frame.zaxis * SAFE_DIST
    )

    script += ur.move_l(safe_frame, acceleration, velocity)
    frames.append(safe_frame)

    script += ur.move_l(pick_frame, acceleration, velocity)
    frames.append(pick_frame)

    script += ur.set_digital_out(IO, signal=True)
    script += ur.sleep(2)

    script += ur.move_l(safe_frame, acceleration, velocity)
    frames.append(safe_frame)

    return script, frames


def place_brick(script, place_frame, acceleration, velocity, IO):

    frames = []

    safe_frame = place_frame.translated(
        place_frame.zaxis * SAFE_DIST
    )

    script += ur.move_l(safe_frame, acceleration, velocity)
    frames.append(safe_frame)

    script += ur.move_l(
        place_frame,
        acceleration / 4,
        velocity / 4
    )
    frames.append(place_frame)

    script += ur.sleep(1)
    script += ur.set_digital_out(IO, signal=False)

    script += ur.move_l(
        safe_frame,
        acceleration / 4,
        velocity / 4
    )
    frames.append(safe_frame)

    return script, frames


#if value given for tcp measured, then add line to script, otherwise it will take current tcp from robot
if tcp_measured is not None:
    script += ur.set_tcp_by_angles(tcp_measured.X, tcp_measured.Y, tcp_measured.Z, m.radians(0.0),m.radians(0.0),m.radians(0))

# ============================================================
# GENERATE PICK AND PLACE SEQUENCE — PALLETIZED PICKUP
# ============================================================

vis_frames = []
pallet_pick_frames = []

# Pallet dimensions
x_bricks = 3
y_bricks = 2
z_bricks = 10

bricks_per_layer = x_bricks * y_bricks
n_layers = z_bricks

brick_length = 32
brick_width = 15
brick_height = 10


for n, place_frame in enumerate(way_frames):

    # ========================================================
    # PALLET INDEX
    # ========================================================

    # Layer: 0, 1, 2...
    layer = n // bricks_per_layer

    # Position within the current layer
    index_in_layer = n % bricks_per_layer

    # X index: 0, 1, 2... x_bricks-1
    i = index_in_layer % x_bricks

    # Y index: 0, 1, 2... y_bricks-1
    j = index_in_layer // x_bricks

    # ========================================================
    # CALCULATE PICKUP POSITION
    # ========================================================

    dx = i * brick_length
    dy = j * brick_width
    dz = layer * brick_height

    print (dz)
    # Translate the calibrated pickup frame in global XYZ
    current_pick_frame = pick_frame.translated(
    pick_frame.xaxis * dx
    + pick_frame.yaxis * dy
    + pick_frame.zaxis * dz
    )

    pallet_pick_frames.append(current_pick_frame)

    # ========================================================
    # PICKUP
    # ========================================================

    script, pickup_frames = pickup_brick(
        script,
        current_pick_frame,
        acceleration, velocity, IO
    )

    # ========================================================
    # PLACEMENT
    # ========================================================

    script, placement_frames = place_brick(
            script,
            place_frame,
            acceleration, velocity, IO
            )


    # Pause after every layer (related to feeder size)

    if (i + 1) % (bricks_per_layer * n_layers) == 0:
        # popup_script = ur.popup(">:0 gimme BRICK", "ATTENTION", blocking=True)
        script += '\tpopup(">:0 PALLET EMPTY, REFILL ME PLEASE!", title="ATTENTION", blocking=True)\n'


script = com.concatenate_script(script)

# Visualize
from compas_rhino import conversions
import Rhino.Geometry as rg

vis_planes = [conversions.frame_to_rhino(frame) for frame in vis_frames]
# ---------- end compas_2 ----------

# ---- group: Send UR script to Robot!
py3_4 = Python3Script(script=compas.script, ip_address=panel, send=Button())  # -> out, a; inputs script: String, ip_address: String, send: Boolean
# ---------- py3_4: Python ----------
import simple_comm as com

if send:
    com.send_script(script,ip_address)
# ---------- end py3_4 ----------
