# Grasshopper definition 261021_1138_Bricks_JW_fixed.ghx (Grasshopper 1.0.8)

# ---- group: 01 / ADVANCE + TURN
# Generate Geometry
# PLAN 1 / FAST LIVE: PLAN 1 / FAST LIVE
# Adjust forward_step, turn_step, rot_step and num_layers.
# Fixed brick dimensions; cumulative yaw continues through the crown.
# The saved support-corrected shape is the live starting template.
# No nonlinear fitting or full gravity checks run while you edit.
# check_mode only changes report detail. display_mode 0 hides the mesh preview.
# After editing: connect Data 1 to CHECK -> ROBOT, then press CHECK / UPDATE ROBOT.
# A failed check leaves the form visible and blocks robot output.
num_layers = Slider(11, range=3..24)  # disabled
forward_step = Slider(5.5, range=0..15)  # disabled
turn_step = Slider(-11, range=-24..24)  # disabled
rot_step = Slider(-11, range=-24..24)  # disabled
forward_growth = Slider(0, range=0..0.6)  # disabled
crown_step = Slider(20, range=0..35)  # disabled
forward_blend = Slider(0, range=0..1)  # disabled
heading_deg = Slider(135, range=-180..180)  # disabled

# ---- group: 02 / ORIGINAL COURSE PATTERN
arch_mode = Slider(1, range=0..1)  # disabled
bond_mode = Slider(0, range=0..1)  # disabled
apex_extra = Slider(0, range=0..2)  # disabled
gap = Slider(1, range=0.3..12)  # disabled
rail_gap = Slider(1.2, range=0.3..10)  # disabled
curve_bend = Slider(0, range=0..1)  # disabled
course_curve = Curve(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)  # disabled

# ---- group: 03 / CHECK + VIEW
check_mode = Slider(0, range=0..2)  # disabled
# SIX-EIGHT CROSS BOND: SIX-EIGHT CROSS BOND / 19 LAYERS
# Odd banks: 6 bricks = 2 x 3. Even banks: 8 bricks = 4 x 2.
# odd_to_even 2 mm / even_to_odd 8 mm, so the fragile transition advances less.
# rot_step is ONE cumulative increment, default 3.5 degrees. heading_deg rotates the complete bridge.
# The bank path follows the previous course axis; height, opening and top-view path are a compromise from the old 13-layer form.
# Crown closure uses 6 bricks in 3 x 2, including bricks connecting BOTH banks.
# Local bearing is distinct from whole-stack equilibrium. Robot frames are generated automatically. Structural analysis does not gate frame output. Sender stays locked.
# ROBOT FRAME ADAPTER: connect Data 1 OR Data 2 directly. No CHECK button is needed.
# This conversion is not a structural or collision approval. TCP, dispenser, program and shape settings are preserved from the source file.
display_mode = Slider(0, range=0..2)  # disabled

# ---- group: 01 / LONGITUDINAL BRIDGE
num_layers_2 = Slider(19, range=7..31)  # disabled
even_to_odd = Slider(6.98, range=0..12)  # disabled
heading_deg_2 = Slider(-37.95, range=-180..180)  # disabled
closing_gap = Slider(8, range=1..20)  # disabled
gap_2 = Slider(1, range=0.3..5)  # disabled
odd_to_even = Slider(2, range=0..5)  # disabled
even_columns = Slider(4, range=4..5)  # disabled

# ---- group: 02 / SINGLE ROTATION INPUT
rot_step_2 = Slider(3.5, range=-5..5)  # disabled

# ---- group: 03 / CHECK + VIEW
odd_gap = Slider(1, range=0..5)  # disabled
display_mode_2 = Slider(1, range=0..2)  # disabled

# ---- group: 01 / LONGITUDINAL BRIDGE
num_layers_3 = Slider(19, range=7..31)
even_to_odd_2 = Slider(6.98, range=0..12)
heading_deg_3 = Slider(-37.95, range=-180..180)
closing_gap_2 = Slider(8, range=1..20)
gap_3 = Slider(1, range=0.3..5)
odd_to_even_2 = Slider(2, range=0..5)
even_columns_2 = Slider(4, range=4..5)

# ---- group: 02 / SINGLE ROTATION INPUT
rot_step_3 = Slider(3.5, range=-5..5)

# ---- group: 03 / CHECK + VIEW
odd_gap_2 = Slider(1, range=0..5)
display_mode_3 = Slider(1, range=0..2)

# ----
plan_1_live = OriginalForwardArchGenerator(
    crv=course_curve,
    num_layers=num_layers,
    forward_step=forward_step,
    turn_step=turn_step,
    rot_step=rot_step,
    forward_growth=forward_growth,
    crown_step=crown_step,
    forward_blend=forward_blend,
    heading_deg=heading_deg,
    arch_mode=arch_mode,
    bond_mode=bond_mode,
    apex_extra=apex_extra,
    gap=gap,
    rail_gap=rail_gap,
    curve_bend=curve_bend,
    check_mode=check_mode,
    display_mode=display_mode)  # -> out, geometry, spine, frames, issues, report, data, order, contacts, course_info; inputs crv: Curve, num_layers: Int32, forward_step: Double, turn_step: Double, rot_step: Double, forward_growth: Double, crown_step: Double, forward_blend: Double, heading_deg: Double, arch_mode: Int32, bond_mode: Int32, apex_extra: Int32, gap: Double, rail_gap: Double, curve_bend: Double, check_mode: Int32, display_mode: Int32; disabled
# ---------- plan_1_live: Python ----------
# venv: mas-2627
"""The original incremental walk: advance, turn, rise, then descend.

XY is integrated one step at a time. Neither end is positioned in advance.
World Z is assigned afterwards from the original up/down course schedule.
"""
import math

DEFAULTS=dict(num_layers=11,forward_step=5.5,forward_growth=.12,
              turn_step=-11.0,rot_step=-11.0,crown_step=20.0,
              forward_blend=0.0,apex_extra=0,gap=1.0,rail_gap=1.0,
              curve_bend=.25,bond_mode=0,arch_mode=1,heading_deg=135.0)

def rotate(p,a):
    c,s=math.cos(a),math.sin(a)
    return [c*p[0]-s*p[1],s*p[0]+c*p[1]]

def make_course(crv,edge,extra,gap,rail_gap,bend,bond_mode):
    count=(2+extra) if edge else (3+2*extra)
    pitch=(32+gap) if edge else (15+gap)
    if crv is not None:
        length=crv.GetLength();mid=length/2
        if (count-1)*pitch/2+.11>=mid:raise ValueError('Course curve too short: reduce apex_extra / gap or replace course_curve')
        pp=[crv.PointAtLength(length*j/8) for j in range(9)]
        if max(p.Z for p in pp)-min(p.Z for p in pp)>.01:raise ValueError('course_curve must be horizontal')
        a=crv.PointAtLength(mid-.1);b=crv.PointAtLength(mid+.1)
        if math.hypot(b.X-a.X,b.Y-a.Y)<1e-8:raise ValueError('Degenerate course curve tangent')
        tangent=math.atan2(b.Y-a.Y,b.X-a.X);basis=tangent-math.pi/2
        origin=crv.PointAtLength(mid)
    out=[]
    for j in range(count):
        station=(j-(count-1)/2)*pitch
        if crv is None:x,y,angle=0,station,0
        else:
            s=mid+station;p=crv.PointAtLength(s);a=crv.PointAtLength(s-.1);b=crv.PointAtLength(s+.1)
            x,y=rotate([p.X-origin.X,p.Y-origin.Y],-basis);x*=bend
            angle=math.atan2(b.Y-a.Y,b.X-a.X)-tangent
            while angle>math.pi:angle-=2*math.pi
            while angle<-math.pi:angle+=2*math.pi
            angle*=bend
        w=15 if bond_mode else 10
        for side in (-1,1) if edge else (0,):
            offset=side*(w+rail_gap)/2 if edge else 0
            q=rotate([offset,0],angle)
            out.append(dict(center=[x+q[0],y+q[1]],angle=angle+(math.pi/2 if edge else 0),
                            size=[32,15,10] if not edge or bond_mode else [32,10,15],
                            pose='B1' if not edge else ('B2' if bond_mode else 'B3')))
    average=[sum(b['center'][k] for b in out)/len(out) for k in (0,1)]
    for b in out:b['center']=[b['center'][k]-average[k] for k in (0,1)]
    return out

def raw_generate(crv=None,**parameters):
    p=DEFAULTS.copy();p.update(parameters)
    if any(not math.isfinite(float(v)) for v in p.values()):raise ValueError('All controls must be finite')
    n=int(p['num_layers'])
    if n!=p['num_layers'] or not 3<=n<=30:raise ValueError('num_layers must be an integer from 3 to 30')
    for name in ('arch_mode','bond_mode'):
        if p[name] not in (0,1):raise ValueError(name+' must be 0 or 1')
    if not 0<=p['forward_step']<=40 or not 0<=p['crown_step']<=60 or not 0<=p['forward_growth']<=2:
        raise ValueError('Invalid forward step, crown step or forward growth')
    if not 0<=p['forward_blend']<=1 or not 0<=p['curve_bend']<=1:raise ValueError('Blend / bend must be between zero and one')
    if int(p['apex_extra'])!=p['apex_extra'] or not 0<=p['apex_extra']<=2:raise ValueError('apex_extra must be 0, 1 or 2')
    if not .3<=p['gap']<=14 or not .3<=p['rail_gap']<=12:raise ValueError('Invalid joint or rail gap')
    apex=n-1;count=2*n-1 if p['arch_mode'] else n
    heights=[];bottom=0
    for k in range(n):
        h=10 if p['bond_mode'] or k%2==0 else 15
        heights.append(bottom+h/2);bottom+=h
    heading=math.radians(p['heading_deg'])
    blend_angle=math.atan2(p['forward_blend'],1-p['forward_blend'])
    current=[0.0,0.0];records=[];centres=[];courses=[];strides=[];angles=[];s_values=[];distance=0
    for i in range(count):
        if i>0:
            # The next point depends on the PREVIOUS point, as in the user's first script.
            stride=p['forward_step']+(i-1)*p['forward_growth']
            if p['arch_mode'] and p['crown_step']>0:
                bump=math.exp(-((i-.5-apex)/1.25)**2)
                stride+=(max(stride,p['crown_step'])-stride)*bump
            angle=heading+blend_angle+math.radians((i-1)*p['turn_step'])
            current=[current[0]+stride*math.cos(angle),current[1]+stride*math.sin(angle)]
            distance+=stride;strides.append(stride)
        k=min(i,2*apex-i) if p['arch_mode'] else i
        c=[current[0],current[1],heights[k]]
        yaw=heading+math.radians(i*p['rot_step'])
        extra=int(round(p['apex_extra']*math.sin(math.pi*i/(count-1))**2)) if p['arch_mode'] else 0
        template=make_course(crv,bool(k%2),extra,p['gap'],p['rail_gap'],p['curve_bend'],int(p['bond_mode']))
        branch='left' if i<apex else ('crown' if i==apex else 'right')
        if not p['arch_mode']:branch='tower'
        course=[]
        for j,b in enumerate(template):
            q=rotate(b['center'],yaw)
            ident='P%02d-B%02d'%(i+1,j+1)
            records.append(dict(id=ident,layer=k,level=k,path_index=i,branch=branch,
                center=[c[0]+q[0],c[1]+q[1],c[2]],angle=yaw+b['angle'],size=b['size'][:],pose=b['pose']))
            course.append(ident)
        centres.append(c);courses.append(course);angles.append(yaw);s_values.append(distance)
    order=[b['id'] for k in range(n) for b in records if b['level']==k]
    return dict(records=records,order=order,centres=centres,courses=courses,
        course_yaws=angles,strides=strides,path_distances=s_values,parameters=p,
        levels=n,total_courses=count,height=bottom,
        plan_sweep_deg=p['turn_step']*max(0,count-2),
        total_rotation_deg=p['rot_step']*(count-1),
        path_rule='C[i]=C[i-1]+step[i]*[cos(heading+(i-1)*turn),sin(heading+(i-1)*turn)]')


SEED_PARAMETERS={'num_layers': 11.0, 'forward_step': 5.5, 'turn_step': -11.0, 'rot_step': -11.0, 'forward_growth': 0.0, 'crown_step': 20.0, 'forward_blend': 0.0, 'heading_deg': 135.0, 'arch_mode': 1.0, 'bond_mode': 0.0, 'apex_extra': 0.0, 'gap': 1.0, 'rail_gap': 1.2, 'curve_bend': 0.0}
SEED={'P01-B01': {'center': [6.979837500850346, 7.508359611962873, 5.0], 'angle': 2.356194490192345, 'size': [32, 15, 10]}, 'P01-B02': {'center': [-5.475249918379779, -5.111391202853871, 5.0], 'angle': 2.356194490192345, 'size': [32, 15, 10]}, 'P01-B03': {'center': [-17.66619555851737, -14.557915226024942, 5.0], 'angle': 2.356194490192345, 'size': [32, 15, 10]}, 'P02-B01': {'center': [17.334033075007817, 0.9455332044473065, 17.5], 'angle': 3.735004599267865, 'size': [32, 10, 15]}, 'P02-B02': {'center': [-4.861417235568533, 13.82853062932382, 17.5], 'angle': 3.735004599267865, 'size': [32, 10, 15]}, 'P02-B03': {'center': [-12.274225119831426, -12.92023968626299, 17.5], 'angle': 3.735004599267865, 'size': [32, 10, 15]}, 'P02-B04': {'center': [-27.82344408620596, -9.89068489805574, 17.5], 'angle': 3.735004599267865, 'size': [32, 10, 15]}, 'P03-B01': {'center': [10.387450886378979, 8.605483913546735, 30.0], 'angle': 1.9722220547535922, 'size': [32, 15, 10]}, 'P03-B02': {'center': [-6.142283727162815, 0.8191209730350167, 30.0], 'angle': 1.9722220547535922, 'size': [32, 15, 10]}, 'P03-B03': {'center': [-20.285857288809215, -5.018069292676776, 30.0], 'angle': 1.9722220547535922, 'size': [32, 15, 10]}, 'P04-B01': {'center': [9.573540611506019, -4.975190200121031, 42.5], 'angle': 3.3510321638291125, 'size': [32, 10, 15]}, 'P04-B02': {'center': [4.3821819222253575, 6.065531908360051, 42.5], 'angle': 3.3510321638291125, 'size': [32, 10, 15]}, 'P04-B03': {'center': [-22.348879007047437, -10.146438619382263, 42.5], 'angle': 3.3510321638291125, 'size': [32, 10, 15]}, 'P04-B04': {'center': [-27.997377505927652, 3.044962803038487, 42.5], 'angle': 3.3510321638291125, 'size': [32, 10, 15]}, 'P05-B01': {'center': [10.351016611106372, -2.183585365769026, 55.0], 'angle': 1.5882496193148399, 'size': [32, 15, 10]}, 'P05-B02': {'center': [-5.209529896759573, 3.3704709940349433, 55.0], 'angle': 1.5882496193148399, 'size': [32, 15, 10]}, 'P05-B03': {'center': [-20.491948801150524, 2.2297295673647803, 55.0], 'angle': 1.5882496193148399, 'size': [32, 15, 10]}, 'P06-B01': {'center': [6.922661361612109, -6.175220253752949, 67.5], 'angle': 2.9670597283903604, 'size': [32, 10, 15]}, 'P06-B02': {'center': [8.711233810158957, 3.9683002717513522, 67.5], 'angle': 2.9670597283903604, 'size': [32, 10, 15]}, 'P06-B03': {'center': [-24.447368476683838, 1.9248085701901503, 67.5], 'angle': 2.9670597283903604, 'size': [32, 10, 15]}, 'P06-B04': {'center': [-22.658792253386743, 12.068328429021966, 67.5], 'angle': 2.9670597283903604, 'size': [32, 10, 15]}, 'P07-B01': {'center': [9.281271911180287, -3.9142431642588384, 80.0], 'angle': 1.2042771838760873, 'size': [32, 15, 10]}, 'P07-B02': {'center': [-3.041437569683989, 6.677551196316181, 80.0], 'angle': 1.2042771838760873, 'size': [32, 15, 10]}, 'P07-B03': {'center': [-17.175636341711932, 12.554910643878738, 80.0], 'angle': 1.2042771838760873, 'size': [32, 15, 10]}, 'P08-B01': {'center': [5.9905393162359095, -7.010658680936508, 92.5], 'angle': 2.5830872929516078, 'size': [32, 10, 15]}, 'P08-B02': {'center': [11.734332457533558, 1.5457585761892991, 92.5], 'angle': 2.5830872929516078, 'size': [32, 10, 15]}, 'P08-B03': {'center': [-20.760539081297896, 11.131348158792266, 92.5], 'angle': 2.5830872929516078, 'size': [32, 10, 15]}, 'P08-B04': {'center': [-13.518412982628249, 22.085599298889047, 92.5], 'angle': 2.5830872929516078, 'size': [32, 10, 15]}, 'P09-B01': {'center': [5.1220170235835445, -4.836366374916906, 105.0], 'angle': 0.8203047484373349, 'size': [32, 15, 10]}, 'P09-B02': {'center': [-1.8170603315713536, 10.362398213525053, 105.0], 'angle': 0.8203047484373349, 'size': [32, 15, 10]}, 'P09-B03': {'center': [-14.222553970611074, 19.493206547442846, 105.0], 'angle': 0.8203047484373349, 'size': [32, 15, 10]}, 'P10-B01': {'center': [4.389092876804862, -4.690700264326109, 117.5], 'angle': 2.199114857512855, 'size': [32, 10, 15]}, 'P10-B02': {'center': [12.870355263860466, 1.159251870798183, 117.5], 'angle': 2.199114857512855, 'size': [32, 10, 15]}, 'P10-B03': {'center': [-12.669722942191509, 22.840340255038242, 117.5], 'angle': 2.199114857512855, 'size': [32, 10, 15]}, 'P10-B04': {'center': [-3.9205605541995685, 28.88493310642744, 117.5], 'angle': 2.199114857512855, 'size': [32, 10, 15]}, 'P11-B01': {'center': [18.232285672374214, 7.539653305331979, 130.0], 'angle': 0.43633231299858233, 'size': [32, 15, 10]}, 'P11-B02': {'center': [11.76622587367871, 21.406163190551084, 130.0], 'angle': 0.43633231299858233, 'size': [32, 15, 10]}, 'P11-B03': {'center': [5.3001653734072365, 35.27267373301304, 130.0], 'angle': 0.43633231299858233, 'size': [32, 15, 10]}, 'P12-B01': {'center': [25.05125254757872, 11.4947814556268, 117.5], 'angle': 1.8151424220741026, 'size': [32, 10, 15]}, 'P12-B02': {'center': [35.28732041490763, 13.015880211707005, 117.5], 'angle': 1.8151424220741026, 'size': [32, 10, 15]}, 'P12-B03': {'center': [13.633358906731154, 41.936801067697886, 117.5], 'angle': 1.8151424220741026, 'size': [32, 10, 15]}, 'P12-B04': {'center': [23.627405431226357, 44.42859672797211, 117.5], 'angle': 1.8151424220741026, 'size': [32, 10, 15]}, 'P13-B01': {'center': [33.0931660155409, 14.22841283043698, 105.0], 'angle': 0.05235987755982974, 'size': [32, 15, 10]}, 'P13-B02': {'center': [27.023236680718, 29.23129820740261, 105.0], 'angle': 0.05235987755982974, 'size': [32, 15, 10]}, 'P13-B03': {'center': [27.539317883261223, 44.57934177109087, 105.0], 'angle': 0.05235987755982974, 'size': [32, 15, 10]}, 'P14-B01': {'center': [25.381202780511455, 18.901697637807988, 92.5], 'angle': 1.43116998663535, 'size': [32, 10, 15]}, 'P14-B02': {'center': [35.16084259035571, 10.513830678946748, 92.5], 'angle': 1.43116998663535, 'size': [32, 10, 15]}, 'P14-B03': {'center': [28.30518285161515, 51.10818958812616, 92.5], 'angle': 1.43116998663535, 'size': [32, 10, 15]}, 'P14-B04': {'center': [39.1097195629238, 42.576616017928885, 92.5], 'angle': 1.43116998663535, 'size': [32, 10, 15]}, 'P15-B01': {'center': [27.163314684370857, 15.310517452782632, 80.0], 'angle': -0.33161255787892285, 'size': [32, 15, 10]}, 'P15-B02': {'center': [33.57408076493297, 29.75496844797176, 80.0], 'angle': -0.33161255787892285, 'size': [32, 15, 10]}, 'P15-B03': {'center': [37.49051366062523, 44.58802887992081, 80.0], 'angle': -0.33161255787892285, 'size': [32, 15, 10]}, 'P16-B01': {'center': [19.580058270051182, 24.43709839180045, 67.5], 'angle': 1.0471975511965979, 'size': [32, 10, 15]}, 'P16-B02': {'center': [36.65057337360041, 9.980980003639655, 67.5], 'angle': 1.0471975511965979, 'size': [32, 10, 15]}, 'P16-B03': {'center': [39.9165786180818, 49.99263027891132, 67.5], 'angle': 1.0471975511965979, 'size': [32, 10, 15]}, 'P16-B04': {'center': [47.40643862079681, 41.06790570615791, 67.5], 'angle': 1.0471975511965979, 'size': [32, 10, 15]}, 'P17-B01': {'center': [24.900140511030628, 17.908530932008606, 55.0], 'angle': -0.715584993317675, 'size': [32, 15, 10]}, 'P17-B02': {'center': [36.53533296133181, 28.694961855630595, 55.0], 'angle': -0.715584993317675, 'size': [32, 15, 10]}, 'P17-B03': {'center': [46.77784768895303, 40.06397843798389, 55.0], 'angle': -0.715584993317675, 'size': [32, 15, 10]}, 'P18-B01': {'center': [15.937893099776375, 25.705181401512814, 42.5], 'angle': 0.6632251157578453, 'size': [32, 10, 15]}, 'P18-B02': {'center': [36.21989261815986, 14.389162665601551, 42.5], 'angle': 0.6632251157578453, 'size': [32, 10, 15]}, 'P18-B03': {'center': [43.59063345729944, 42.77518442781839, 42.5], 'angle': 0.6632251157578453, 'size': [32, 10, 15]}, 'P18-B04': {'center': [58.246001160448095, 38.6609259706945, 42.5], 'angle': 0.6632251157578453, 'size': [32, 10, 15]}, 'P19-B01': {'center': [23.824408698928263, 18.35330223403116, 30.0], 'angle': -1.0995574287564276, 'size': [32, 15, 10]}, 'P19-B02': {'center': [42.20520019465653, 27.718759287147595, 30.0], 'angle': -1.0995574287564276, 'size': [32, 15, 10]}, 'P19-B03': {'center': [55.837599954458604, 34.66481406808937, 30.0], 'angle': -1.0995574287564276, 'size': [32, 15, 10]}, 'P20-B01': {'center': [24.558481610394036, 29.336223501723445, 17.5], 'angle': 0.27925268031909267, 'size': [32, 10, 15]}, 'P20-B02': {'center': [27.885163601080617, 19.575049988732307, 17.5], 'angle': 0.27925268031909267, 'size': [32, 10, 15]}, 'P20-B03': {'center': [57.0218069285138, 35.14645537498545, 17.5], 'angle': 0.27925268031909267, 'size': [32, 10, 15]}, 'P20-B04': {'center': [59.86087191286265, 25.245459587335308, 17.5], 'angle': 0.27925268031909267, 'size': [32, 10, 15]}, 'P21-B01': {'center': [24.57705156453261, 23.611765880433246, 5.0], 'angle': -1.4835298641951802, 'size': [32, 15, 10]}, 'P21-B02': {'center': [40.8933139943356, 21.73047876286029, 5.0], 'angle': -1.4835298641951802, 'size': [32, 15, 10]}, 'P21-B03': {'center': [56.13509362971126, 23.0639531209296, 5.0], 'angle': -1.4835298641951802, 'size': [32, 15, 10]}}

def generate(crv=None,**p):
    import scriptcontext
    effective_curve=None if p['curve_bend']==0 else crv
    key=('JW_LIGHT_ARCH18',tuple(sorted(p.items())),None if effective_curve is None else int(effective_curve.DataCRC(0)))
    cached=scriptcontext.sticky.get('JW_LIGHT_ARCH18_LAST')
    if cached is not None and cached[0]==key:return cached[1]
    r=raw_generate(effective_curve,**p)
    if p['arch_mode']==SEED_PARAMETERS['arch_mode'] and len(r['records'])==len(SEED):
        base={b['id']:b for b in raw_generate(None,**SEED_PARAMETERS)['records']}
        for b in r['records']:
            old=base.get(b['id']);fit=SEED.get(b['id'])
            if old is None or fit is None or old['size']!=b['size']:continue
            off=rotate([fit['center'][k]-old['center'][k] for k in (0,1)],b['angle']-old['angle'])
            b['center'][:2]=[b['center'][k]+off[k] for k in (0,1)]
        by_id={b['id']:b for b in r['records']}
        r['centres']=[[sum(by_id[i]['center'][k] for i in course)/len(course) for k in range(3)] for course in r['courses']]
    r['design']='PLAN 1';scriptcontext.sticky['JW_LIGHT_ARCH18_LAST']=(key,r);return r

def preview_and_data(result,show,detail):
    import json,math,Rhino.Geometry as rg
    geometry=[];frames=[];spine=[];issues=[];contacts=[];course_info=[]
    if show:
        for b in result['records']:
            x,y,z=b['center'];l,w,h=b['size'];a=b['angle']
            plane=rg.Plane(rg.Point3d(x,y,z),rg.Vector3d(math.cos(a),math.sin(a),0),rg.Vector3d(-math.sin(a),math.cos(a),0))
            box=rg.Box(plane,rg.Interval(-l/2,l/2),rg.Interval(-w/2,w/2),rg.Interval(-h/2,h/2))
            geometry.append(rg.Mesh.CreateFromBox(box,1,1,1))
            if show==2:frames.append(plane)
        if 'centres' in result:
            spine=[rg.Polyline([rg.Point3d(*q) for q in result['centres']]).ToNurbsCurve()]
        elif 'fronts' in result:
            for side in (0,1):
                pts=[]
                for i,front in enumerate(result['fronts']):
                    x=front[side];a=result['course_yaws'][i];z=result['layer_info'][i]['bed_z']
                    pts.append(rg.Point3d(x*math.cos(a),x*math.sin(a),z))
                if len(pts)>1:spine.append(rg.Polyline(pts).ToNurbsCurve())
    # No contact polygons, gravity reports or duplicated geometry go into the live wire.
    compact=dict(schema='JW_LIGHT_V18',design=result['design'],records=[{k:b[k] for k in ('id','level','center','angle','size','pose')} for b in result['records']],order=result['order'])
    data=json.dumps(compact,separators=(',',':'),allow_nan=False)
    report='%s / %d bricks / LIVE PREVIEW\nHeavy automatic fitting and staged gravity are disabled in this generator.\nPress CHECK / UPDATE ROBOT after changing the form.'%(result['design'],len(result['records']))
    if result.get('support_fit'):
        report+='\nLocal bearing fit: minimum %.2f%%. Full assembly equilibrium still needs CHECK.'%(100*result['support_fit']['min_ratio'])
    if detail:
        report+='\nLayer counts: '+', '.join(str(sum(b['level']==k for b in result['records'])) for k in sorted({b['level'] for b in result['records']}))
    return geometry,spine,frames,issues,report,data,result['order'],contacts,course_info


import json,Rhino,Grasshopper as gh
geometry=[];spine=[];frames=[];issues=[];report='';data='';order=[];contacts=[];course_info=[]
try:
    if Rhino.RhinoDoc.ActiveDoc.ModelUnitSystem!=Rhino.UnitSystem.Millimeters:raise ValueError('Use Rhino millimetres for fixed-size bricks.')
    params=dict(num_layers=int(num_layers),forward_step=float(forward_step),forward_growth=float(forward_growth),turn_step=float(turn_step),rot_step=float(rot_step),crown_step=float(crown_step),forward_blend=float(forward_blend),apex_extra=int(apex_extra),gap=float(gap),rail_gap=float(rail_gap),curve_bend=float(curve_bend),bond_mode=int(bond_mode),arch_mode=int(arch_mode),heading_deg=float(heading_deg))
    result=generate(crv,**params)
    geometry,spine,frames,issues,report,data,order,contacts,course_info=preview_and_data(result,int(display_mode),int(check_mode))
    ghenv.Component.Message='%s | %d bricks | LIVE'%(result['design'],len(result['records']))
except Exception as exc:
    report=str(exc);data=json.dumps(dict(error=str(exc)))
    ghenv.Component.Message='INPUT ERROR';ghenv.Component.AddRuntimeMessage(gh.Kernel.GH_RuntimeMessageLevel.Error,str(exc))
# ---------- end plan_1_live ----------

plan_2_six_eight_bridge = ForwardCorbelBridgeGenerator(
    num_layers=num_layers_2,
    even_to_odd=even_to_odd,
    heading_deg=heading_deg_2,
    closing_gap=closing_gap,
    gap=gap_2,
    odd_to_even=odd_to_even,
    even_columns=even_columns,
    rot_step=rot_step_2,
    odd_gap=odd_gap,
    display_mode=display_mode_2)  # -> out, geometry, spine, frames, issues, report, data, order, contacts, course_info; inputs num_layers: Int32, even_to_odd: Double, heading_deg: Double, closing_gap: Double, gap: Double, odd_to_even: Double, even_columns: Int32, rot_step: Double, odd_gap: Int32, display_mode: Int32; disabled
# ---------- plan_2_six_eight_bridge: Python ----------
# venv: mas-2627
import math
def generate(num_layers=19,even_to_odd=8.,odd_to_even=2.,heading_deg=-31.5,closing_gap=8.,gap=1.,odd_gap=1.,even_columns=4,rot_step=3.5):
    n=int(num_layers);ec=int(even_columns)
    if n!=num_layers or not 7<=n<=31 or ec not in (4,5):raise ValueError('Use 7..31 layers and 4 or 5 even columns.')
    if not all(math.isfinite(float(v)) for v in (even_to_odd,odd_to_even,heading_deg,closing_gap,gap,odd_gap,rot_step)):raise ValueError('Use finite numbers.')
    if min(gap,odd_gap,closing_gap)<=0 or min(even_to_odd,odd_to_even)<0:raise ValueError('Use positive gaps and nonnegative advances.')
    yaw=[math.radians(heading_deg+i*rot_step) for i in range(n)];last=n-2
    half=(ec*15+(ec-1)*gap)/2 if last%2 else (64+odd_gap)/2
    centres=[[0.,0.] for i in range(n-1)];centres[last]=[(half+closing_gap/2)*math.cos(yaw[last]),(half+closing_gap/2)*math.sin(yaw[last])]
    for i in range(last-1,-1,-1):
        advance=odd_to_even if (i+1)%2 else even_to_odd
        centres[i]=[centres[i+1][j]+advance*(math.cos(yaw[i]) if j==0 else math.sin(yaw[i])) for j in (0,1)]
    records=[];courses=[];fronts=[];info=[]
    for i in range(n):
        a=yaw[i];c,s=math.cos(a),math.sin(a);floor=[]
        if i==n-1:
            grid=[(u,v,'crown') for u in (-(32+gap),0,32+gap) for v in (-(15+gap)/2,(15+gap)/2)];angle=a
        else:
            cross=bool(i%2);angle=a+(math.pi/2 if cross else 0)
            us=[(j-(ec-1)/2)*(15+gap) for j in range(ec)] if cross else [-(32+odd_gap)/2,(32+odd_gap)/2]
            vs=[-(32+gap)/2,(32+gap)/2] if cross else [-(15+gap),0,15+gap]
            grid=[(u,v,branch) for branch in ('left','right') for u in sorted(us,key=lambda u:-abs(u)) for v in vs]
        for u,v,branch in grid:
            side=-1 if branch=='left' else 1;cx,cy=(0,0) if branch=='crown' else (side*centres[i][0],side*centres[i][1])
            ident='L%02d-B%03d'%(i+1,len(floor)+1);b=dict(id=ident,level=i,center=[cx+c*u-s*v,cy+s*u+c*v,i*10.+5],angle=angle,size=[32.,15.,10.],pose='B2' if i%2 and i!=n-1 else 'B1',branch=branch)
            floor.append(ident);records.append(b)
        courses.append(floor);fronts.append([0,0]);info.append(dict(layer=i+1,bricks=len(floor),bed_z=10*i,yaw_deg=heading_deg+i*rot_step))
    return dict(records=records,order=[b['id'] for b in records],courses=courses,layer_info=info,course_yaws=yaw,fronts=fronts,height=n*10.,design='PLAN 2 / SIX-EIGHT ALTERNATING BRIDGE',parameters=locals().get('n'))

def preview_and_data(result,show,detail):
    import json,Rhino.Geometry as rg
    geometry=[];frames=[]
    if show:
        for b in result['records']:
            x,y,z=b['center'];a=b['angle'];p=rg.Plane(rg.Point3d(x,y,z),rg.Vector3d(math.cos(a),math.sin(a),0),rg.Vector3d(-math.sin(a),math.cos(a),0));box=rg.Box(p,rg.Interval(-16,16),rg.Interval(-7.5,7.5),rg.Interval(-5,5));geometry.append(rg.Mesh.CreateFromBox(box,1,1,1))
            if show==2:frames.append(p)
    data=json.dumps(dict(schema='JW_LIGHT_V18',design=result['design'],records=result['records'],order=result['order']),separators=(',',':'))
    report=('SIX-EIGHT BRIDGE / odd banks 2x3 = 6, even banks 4x2 = 8. Crown: 6 bricks in 3x2 closure.\n'
        'odd_to_even = 2 mm; even_to_odd = 8 mm; cumulative yaw increment = 3.5 deg at defaults.\n'
        'The advance follows the previous course axis. Each complete course rotates about its bank centre.\n'
        '19 layers default. Height/opening/top-view path differ from the 13-layer file.\n'
        'Local contact is checked separately; full stack gravity and robot tool collision are NOT guaranteed.\n'
        'CHECK / UPDATE ROBOT retains its full validation gate; sender stays locked.')
    return geometry,[],frames,[],report,data,result['order'],[],[]

import json,Rhino,Grasshopper as gh
geometry=[];spine=[];frames=[];issues=[];report='';data='';order=[];contacts=[];course_info=[]
try:
    if Rhino.RhinoDoc.ActiveDoc.ModelUnitSystem!=Rhino.UnitSystem.Millimeters:raise ValueError('Use Rhino millimetres.')
    result=generate(num_layers=int(num_layers),even_to_odd=float(even_to_odd),odd_to_even=float(odd_to_even),heading_deg=float(heading_deg),closing_gap=float(closing_gap),gap=float(gap),odd_gap=float(odd_gap),even_columns=int(even_columns),rot_step=float(rot_step))
    geometry,spine,frames,issues,report,data,order,contacts,course_info=preview_and_data(result,int(display_mode),0)
    ghenv.Component.Message='6 / 8 BRICKS | %d LAYERS'%int(num_layers)
except Exception as exc:
    data=json.dumps(dict(error=str(exc)));ghenv.Component.AddRuntimeMessage(gh.Kernel.GH_RuntimeMessageLevel.Error,str(exc))
# ---------- end plan_2_six_eight_bridge ----------

plan_2_six_eight_bridge_2 = ForwardCorbelBridgeGenerator(
    num_layers=num_layers_3,
    even_to_odd=even_to_odd_2,
    heading_deg=heading_deg_3,
    closing_gap=closing_gap_2,
    gap=gap_3,
    odd_to_even=odd_to_even_2,
    even_columns=even_columns_2,
    rot_step=rot_step_3,
    odd_gap=odd_gap_2,
    display_mode=display_mode_3)  # -> out, geometry, spine, frames, issues, report, data, order, contacts, course_info; inputs num_layers: Int32, even_to_odd: Double, heading_deg: Double, closing_gap: Double, gap: Double, odd_to_even: Double, even_columns: Int32, rot_step: Double, odd_gap: Int32, display_mode: Int32; same code as plan_2_six_eight_bridge

# ----
# Measure work object
panel = Panel("192.168.10.10")
point = ValueList({"origin", "xaxis", "xypoint"}, selected="origin")
capture = Button()
capture_wobj = CaptureWobj(robot_ip=panel, point_name=point, capture=capture)  # -> wobj_origin, wobj_xaxis, wobj_xypoint, info
# ---------- capture_wobj: Python ----------
"""
Capture the 3 points that define the work object (robot base) plane.

Jog the TCP to a point, pick its name (origin / xaxis / xypoint) and press capture.
The TCP position (robot base frame, mm) is saved to wobj_calibration.json next to
this .ghx file, so the points survive closing Grasshopper.
"""
import os
import sys
import json
import time

import scriptcontext as sc
import Rhino.Geometry as rg

NAMES = ["origin", "xaxis", "xypoint"]

gh_dir = os.path.dirname(ghenv.Component.OnPingDocument().FilePath)
src_dir = os.path.join(gh_dir, "src")
if src_dir not in sys.path:
    sys.path.append(src_dir)
import simple_comm as com

path = os.path.join(gh_dir, "wobj_calibration.json")

data = {}
if os.path.exists(path):
    with open(path) as f:
        data = json.load(f)

# keep the last status in sticky, so the message survives the button being released
status_key = "capture_status_" + str(ghenv.Component.InstanceGuid)

if capture:
    if point_name not in NAMES:
        sc.sticky[status_key] = "pick origin / xaxis / xypoint"
    else:
        try:
            x, y, z = list(com.listen_to_robot(robot_ip)["pose"])[:3]  # metres, robot base frame
            data[point_name] = [round(x * 1000, 2), round(y * 1000, 2), round(z * 1000, 2)]  # -> mm
            with open(path, "w") as f:
                json.dump(data, f, indent=2)
            sc.sticky[status_key] = "{} captured {}".format(point_name, time.strftime("%H:%M:%S"))
        except Exception as e:
            print(e)
            sc.sticky[status_key] = "robot not reachable"

ghenv.Component.Message = sc.sticky.get(status_key, "")

def pt(name):
    return rg.Point3d(*data[name]) if name in data else None

wobj_origin, wobj_xaxis, wobj_xypoint = pt("origin"), pt("xaxis"), pt("xypoint")
info = json.dumps(data, indent=2)
# ---------- end capture_wobj ----------
wobj_calibration = Panel(capture_wobj.info)

# ---- group: Data 2
data = Data(plan_2_six_eight_bridge_2.data)

# ----
data_robot_frames = DATAROBOT(data=data)  # -> way_planes, brick_heights, brick_widths, part_ids
# ---------- data_robot_frames: Python ----------
# r: compas
# venv: mas-2627
"""Convert ordered design data to COMPAS TCP frames. No structural analysis."""
import json,math
from compas.geometry import Frame
import Grasshopper as gh

def convert_data(payload):
    state=json.loads(str(payload));records=state.get('records',[]);order=state.get('order',[])
    if not isinstance(records,list) or not records:raise ValueError(state.get('error','No brick data. Connect Data 1 OR Data 2.'))
    if not isinstance(order,list):raise ValueError('Brick order must be a list.')
    by_id={b['id']:b for b in records}
    if len(by_id)!=len(records) or len(order)!=len(records) or len(set(order))!=len(order) or set(order)!=set(by_id):raise ValueError('Order must contain every brick ID exactly once.')
    ff=[];hh=[];ww=[];ids=[]
    for ident in order:
        b=by_id[ident];x,y,z=[float(v) for v in b['center']];length,width,height=[float(v) for v in b['size']];a=float(b['angle'])
        if not all(math.isfinite(v) for v in (x,y,z,length,width,height,a)) or min(length,width,height)<=0:raise ValueError('%s: invalid brick dimensions or position.'%ident)
        if abs(length-32.)>1e-6:raise ValueError('%s: downstream code expects 32 mm brick length.'%ident)
        c,s=math.cos(a),math.sin(a)
        ff.append(Frame([x,y,z+height/2],[-c,-s,0],[-s,c,0]));hh.append(height);ww.append(width);ids.append(ident)
    return ff,hh,ww,ids

way_planes=[];brick_heights=[];brick_widths=[];part_ids=[]
try:
    if ghenv.Component.Params.Input[0].VolatileData.DataCount!=1:raise ValueError('Connect one design payload: Data 1 OR Data 2.')
    ff,hh,ww,ids=convert_data(data)
    way_planes=ff;brick_heights=hh;brick_widths=ww;part_ids=ids
    ghenv.Component.Message='FRAMES | %d BRICKS'%len(ids)
except Exception as exc:
    ghenv.Component.Message='INPUT ERROR';ghenv.Component.AddRuntimeMessage(gh.Kernel.GH_RuntimeMessageLevel.Error,str(exc))
# ---------- end data_robot_frames ----------

path = FilePath("/Users/jamess-z/Desktop/brick_design_01.json")

# ---- group: Data 2
data_2 = Data(plan_2_six_eight_bridge.data)  # disabled

# ---- group: Data 1
data_3 = Data(plan_1_live.data)  # disabled

# ----
# Measure work object
point_2 = ValueList({"origin", "xaxis", "xypoint"}, selected="xypoint")  # disabled
capture_2 = Button()  # disabled
panel_2 = Panel("192.168.10.10")  # disabled
capture_wobj_2 = CaptureWobj(robot_ip=panel_2, point_name=point_2, capture=capture_2)  # -> wobj_origin, wobj_xaxis, wobj_xypoint, info; disabled; same code as capture_wobj
wobj_calibration_2 = Panel(capture_wobj_2.info)  # disabled

data_robot_frames_2 = DATAROBOT(data=data_2)  # -> way_planes, brick_heights, brick_widths, part_ids; disabled; same code as data_robot_frames

py3 = Python3Script(frames=data_robot_frames.way_planes, output_dir=path, write=Button())  # -> out, a; inputs frames: list, output_dir: String, write: Boolean
# ---------- py3: Python ----------
import json
# json always takes a list

data = []

# bricks input as BOX
for frame in frames:
    brick_data = dict(position=[], rotation=[])

    # get the frame
    origin = frame.point
    # print(origin.x, origin.y, origin.z)
    brick_data["position"] = list(origin)

    # get the rotation (euler angles)
    angles = frame.euler_angles()
    brick_data["rotation"] = angles

    data.append(brick_data)

print(type(data))

# write to json
if write:
    with open(output_dir, 'w') as fp:
        json.dump(data, fp, indent=4)
# ---------- end py3 ----------
py3_2 = Python3Script(way_planes=data_robot_frames.way_planes)  # -> out, a; inputs way_planes: list
# ---------- py3_2: Python ----------
# r: compas
# venv: mas-2627

from compas.geometry import Frame
import json

a = ""

bricks_design = dict(position = [0,0,0], rotation = [0,0,0])

for i in range(len(way_planes)):
    
    current_plane = way_planes[i]
    current_point = current_plane.point
    current_angle = current_plane.euler_angles(static=True, axes='xyz')

    bricks_design["position"] = [current_point.x, current_point.y, current_point.z]
    bricks_design["rotation"] = [current_angle[0], current_angle[1], current_angle[2]]

    a += json.dumps(bricks_design)
    
    if i < len(way_planes)-1:
        a += ",\n"

print(a)
# ---------- end py3_2 ----------
pick_calibration = Panel(py3_2.a)

# ----
# Transform from Rhino to Robot Space
fine_adjust_z_mm = Slider(-5.5, range=-5.5..10)
transform = Python3Script(
    way_planes=data_robot_frames.way_planes,
    wobj_origin=capture_wobj.wobj_origin,
    wobj_xaxis=capture_wobj.wobj_xaxis,
    wobj_xypoint=capture_wobj.wobj_xypoint,
    z_safe_margin=fine_adjust_z_mm)  # -> out, transformed_frames; inputs way_planes: list, wobj_origin: Point3d, wobj_xaxis: Point3d, wobj_xypoint: Point3d, z_safe_margin: Double
# ---------- transform: Python ----------
# r: compas
# venv: mas-2627
from compas.geometry import Frame, Transformation, Translation, Vector

#in this step we transform our way planes to robot space

#the rhino co-ordinate system is rather abstract in the physical world

#the robot base plane assumed the base frame of robot is the origin

#but rhino does not know that

#thus we transform things from our design space(Rhino World XY) to Robot Base Plane that we measure



def set_robot_base(origin, xaxis, xypoint):

    """

    set a base plane representing the robot working object plane

    """

    origin = Vector(origin.X, origin.Y, origin.Z) if hasattr(origin, "X") else Vector(*origin)
    xaxis = Vector(xaxis.X, xaxis.Y, xaxis.Z) if hasattr(xaxis, "X") else Vector(*xaxis)
    xypoint = Vector(xypoint.X, xypoint.Y, xypoint.Z) if hasattr(xypoint, "X") else Vector(*xypoint)
    robot_base = Frame(origin, xaxis - origin, xypoint - origin)

    print (robot_base)

    return (robot_base)



def rhino_to_robot_space(rhino_plane,robot_base_plane):

    """

    Transform the objects from Rhino world XY plane to robot work object plane

    """

    T_matrix = Transformation.from_frame_to_frame(Frame.worldXY(), robot_base_plane)

    robot_plane = rhino_plane.transformed(T_matrix)

    return robot_plane



def set_z_safe_margin(planes_to_adjust, safety_margin):

    adjusted = []

    T = Translation.from_vector(Vector(0, 0, safety_margin))

    for f in planes_to_adjust:

        adjusted.append(f.transformed(T))

    return adjusted



way_planes = list(way_planes or [])



# ===== Robot base is set =====

robot_base =  set_robot_base(wobj_origin, wobj_xaxis, wobj_xypoint)



# ===== Set safety margin for Z height ======

safe_planes = set_z_safe_margin(way_planes, z_safe_margin)





# ===== Transforming the rhino planes into robot planes =====

transformed_frames = []

for plane in safe_planes: 

    transformed_frames.append(rhino_to_robot_space(plane, robot_base))
# ---------- end transform ----------
compas_draw = COMPASDraw(cg=transform.transformed_frames)  # -> rg
#   port cg: The COMPAS geometry or datastructure to be drawn.
#   port rg: The Rhino geometry object.
# ---------- compas_draw: Python ----------
# r: compas>=2.14.1
"""
Draws COMPAS geometry in Grasshopper.
"""

from typing import Any

import Grasshopper

from compas.scene import SceneObject


class CompasToRhinoGeometry(Grasshopper.Kernel.GH_ScriptInstance):
    def RunScript(self, cg):
        if not cg:
            return None

        return SceneObject(item=cg).draw()
# ---------- end compas_draw ----------

# ----
# Transform from Rhino to Robot Space
fine_adjust_z_mm_2 = Slider(5, range=-5..10)  # disabled
transform_2 = Python3Script(
    way_planes=data_robot_frames_2.way_planes,
    wobj_origin=capture_wobj_2.wobj_origin,
    wobj_xaxis=capture_wobj_2.wobj_xaxis,
    wobj_xypoint=capture_wobj_2.wobj_xypoint,
    z_safe_margin=fine_adjust_z_mm_2)  # -> out, transformed_frames; inputs way_planes: list, wobj_origin: Point3d, wobj_xaxis: Point3d, wobj_xypoint: Point3d, z_safe_margin: Double; disabled; same code as transform
compas_draw_2 = COMPASDraw(cg=transform_2.transformed_frames)  # -> rg; disabled
#   port cg: The COMPAS geometry or datastructure to be drawn.
#   port rg: The Rhino geometry object.
# ---------- compas_draw_2: Python ----------
# venv: mas-2627
# r: compas>=2.14.1
"""
Draws COMPAS geometry in Grasshopper.
"""

from typing import Any

import Grasshopper

from compas.scene import SceneObject


class CompasToRhinoGeometry(Grasshopper.Kernel.GH_ScriptInstance):
    def RunScript(self, cg):
        if not cg:
            return None

        return SceneObject(item=cg).draw()
# ---------- end compas_draw_2 ----------

# ----
# Measure top left-most position of array
capture_3 = Button()
point_3 = ValueList({"origin", "xaxis", "xypoint"}, selected="origin")
capture_pick = CapturePick(robot_ip=panel, point_name=point_3, capture=capture_3)  # -> origin, xaxis_pt, xy_pt, info
# ---------- capture_pick: Python ----------
"""
Capture the 3 points that define the pick frame at the brick pick-up location.

Jog the TCP to a point, pick its name (origin / xaxis / xypoint) and press capture.
The TCP position (robot base frame, mm) is saved to pick_calibration.json next to
this .ghx file, so the points survive closing Grasshopper.
"""
import os
import sys
import json
import time

import scriptcontext as sc
import Rhino.Geometry as rg

NAMES = ["origin", "xaxis", "xypoint"]

gh_dir = os.path.dirname(ghenv.Component.OnPingDocument().FilePath)
src_dir = os.path.join(gh_dir, "src")
if src_dir not in sys.path:
    sys.path.append(src_dir)
import simple_comm as com

path = os.path.join(gh_dir, "array_calibration.json")

data = {}
if os.path.exists(path):
    with open(path) as f:
        data = json.load(f)

# keep the last status in sticky, so the message survives the button being released
status_key = "capture_status_" + str(ghenv.Component.InstanceGuid)

if capture:
    if point_name not in NAMES:
        sc.sticky[status_key] = "pick origin / xaxis / xypoint"
    else:
        try:
            x, y, z = list(com.listen_to_robot(robot_ip)["pose"])[:3]  # metres, robot base frame
            data[point_name] = [round(x * 1000, 2), round(y * 1000, 2), round(z * 1000, 2)]  # -> mm
            with open(path, "w") as f:
                json.dump(data, f, indent=2)
            sc.sticky[status_key] = "{} captured {}".format(point_name, time.strftime("%H:%M:%S"))
        except Exception as e:
            print(e)
            sc.sticky[status_key] = "robot not reachable"

ghenv.Component.Message = sc.sticky.get(status_key, "")

def pt(name):
    return rg.Point3d(*data[name]) if name in data else None

origin, xaxis_pt, xy_pt = pt("origin"), pt("xaxis"), pt("xypoint")
info = json.dumps(data, indent=2)
# ---------- end capture_pick ----------
pick_calibration_2 = Panel(capture_pick.info)
py3_3 = Python3Script(origin=capture_pick.origin, xaxis_pt=capture_pick.xaxis_pt, xy_pt=capture_pick.xy_pt)  # -> out, array_frames, array_starts; inputs origin: Point3d, xaxis_pt: Point3d, xy_pt: Point3d
# ---------- py3_3: Python ----------
from compas.geometry import Frame, Point
from compas.geometry import Rotation

import math as m

from compas_rhino.conversions import point_to_compas

origin = point_to_compas(origin)
xaxis_pt = point_to_compas(xaxis_pt)
xy_pt = point_to_compas(xy_pt)
array_depth = 10
array_rows = 2
array_columns = 2
brick_height = 9.8
column_distance = 40
row_distance = 79

#define array start
array_start = Frame(origin, xy_pt - origin, xaxis_pt - origin)
array_start = array_start.rotated(m.radians(-90), array_start.zaxis, array_start.point)

array_frames = []
array_starts = []

for l in range(10):
    for k in range (array_rows):
        for j in range(array_columns):
            array_start_copy = array_start.copy()
            array_start_copy.translate(array_start.xaxis * (column_distance * j))
            array_start_copy.translate(array_start.yaxis * (row_distance * k))
            array_starts.append(array_start_copy)
            for i in range(array_depth):
                array_copy = array_start.copy()
                array_copy.translate(array_start.zaxis * (brick_height * i))
                array_copy.translate(array_start.xaxis * (column_distance * j))
                array_copy.translate(array_start.yaxis * (row_distance * k))
                array_frames.append(array_copy)

print(array_starts)
# ---------- end py3_3 ----------

# ----
# Measure pick up location
point_4 = ValueList({"origin", "xaxis", "xypoint"}, selected="xypoint")
capture_4 = Button()
capture_pick_2 = CapturePick(robot_ip=panel, point_name=point_4, capture=capture_4)  # -> origin, xaxis_pt, xy_pt, info
# ---------- capture_pick_2: Python ----------
"""
Capture the 3 points that define the pick frame at the brick pick-up location.

Jog the TCP to a point, pick its name (origin / xaxis / xypoint) and press capture.
The TCP position (robot base frame, mm) is saved to pick_calibration.json next to
this .ghx file, so the points survive closing Grasshopper.
"""
import os
import sys
import json
import time

import scriptcontext as sc
import Rhino.Geometry as rg

NAMES = ["origin", "xaxis", "xypoint"]

gh_dir = os.path.dirname(ghenv.Component.OnPingDocument().FilePath)
src_dir = os.path.join(gh_dir, "src")
if src_dir not in sys.path:
    sys.path.append(src_dir)
import simple_comm as com

path = os.path.join(gh_dir, "pick_calibration.json")

data = {}
if os.path.exists(path):
    with open(path) as f:
        data = json.load(f)

# keep the last status in sticky, so the message survives the button being released
status_key = "capture_status_" + str(ghenv.Component.InstanceGuid)

if capture:
    if point_name not in NAMES:
        sc.sticky[status_key] = "pick origin / xaxis / xypoint"
    else:
        try:
            x, y, z = list(com.listen_to_robot(robot_ip)["pose"])[:3]  # metres, robot base frame
            data[point_name] = [round(x * 1000, 2), round(y * 1000, 2), round(z * 1000, 2)]  # -> mm
            with open(path, "w") as f:
                json.dump(data, f, indent=2)
            sc.sticky[status_key] = "{} captured {}".format(point_name, time.strftime("%H:%M:%S"))
        except Exception as e:
            print(e)
            sc.sticky[status_key] = "robot not reachable"

ghenv.Component.Message = sc.sticky.get(status_key, "")

def pt(name):
    return rg.Point3d(*data[name]) if name in data else None

origin, xaxis_pt, xy_pt = pt("origin"), pt("xaxis"), pt("xypoint")
info = json.dumps(data, indent=2)
# ---------- end capture_pick_2 ----------
pick_calibration_3 = Panel(capture_pick_2.info)
py3_4 = Python3Script(origin=capture_pick_2.origin, xaxis_pt=capture_pick_2.xaxis_pt, xy_pt=capture_pick_2.xy_pt)  # -> out, pick_frame; inputs origin: Point3d, xaxis_pt: Point3d, xy_pt: Point3d
# ---------- py3_4: Python ----------
from compas.geometry import Frame, Point
from compas.geometry import Rotation

import math as m

from compas_rhino.conversions import point_to_compas

origin = point_to_compas(origin)
xaxis_pt = point_to_compas(xaxis_pt)
xy_pt = point_to_compas(xy_pt)
brick_offset = -9.8

#define pick frame
pick_frame = Frame(origin, xaxis_pt - origin, xy_pt - origin)
# pick_frame = pick_frame.rotated(m.pi/2, pick_frame.zaxis, pick_frame.point)
pick_frame = pick_frame.translated(pick_frame.zaxis * brick_offset)
pick_frame = pick_frame.translated(pick_frame.xaxis * 13)
pick_frame = pick_frame.translated(pick_frame.yaxis * 4)
# pick_frame = pick_frame.rotated(m.radians(10), pick_frame.zaxis, pick_frame.point)
# ---------- end py3_4 ----------
compas_draw_3 = COMPASDraw(cg=py3_4.pick_frame)  # -> rg; same code as compas_draw

# ----
# Measure and set TCP
panel_3 = Panel("10.16")
pt = ConstructPoint(XCoordinate=panel_3, YCoordinate="-42.18", ZCoordinate="190.36")

# ----
# Measure and set TCP
panel_4 = Panel("0.06")  # disabled
panel_5 = Panel("-0.46")  # disabled
panel_6 = Panel("149.37")  # disabled
pt_2 = ConstructPoint(XCoordinate=panel_5, YCoordinate=panel_4, ZCoordinate=panel_6)  # disabled

number_slider = Slider(1, range=0..1)
number_slider_2 = Slider(1, range=0..1)

number_slider_3 = Slider(0.1, range=0..0.1)  # disabled
number_slider_4 = Slider(0.1, range=0..0.1)  # disabled

compas_draw_4 = COMPASDraw(cg=[transform.transformed_frames, py3_3.array_frames])  # -> rg; same code as compas_draw
# Convert Planes to URScript
compas = Python3Script(
    way_frames=transform.transformed_frames,
    tcp_measured=pt,
    acceleration=number_slider,
    velocity=number_slider_2,
    pick_frame=py3_4.pick_frame,
    array_starts=py3_3.array_starts,
    array_frames=py3_3.array_frames)  # -> out, vis_frames, vis_planes, script; inputs way_frames: list, tcp_measured: Point3d, acceleration: Double, velocity: Double, array_starts: list, array_frames: list
# ---------- compas: Python ----------
# r: compas
# venv: mas-2627
from importlib import reload
import sys
import os

#get current file path
path = ghenv.Component.OnPingDocument().FilePath
#get parent directory of the parent directory
parentdir = os.path.dirname(path)
#get src folder which contains classes
dire = os.path.join(parentdir,'src')

if dire not in sys.path:
    sys.path.insert(0, dire)

import simple_ur_script as ur
reload(ur)

import utils 
reload(utils)

import simple_comm as com
reload(com)

import compas.geometry as cg
import math as m

# ===== Set global constants =======

IO = 4 # Global constant
SAFE_DIST = 50
BLEND_RAD = 10
BRICK_COUNT = 10

# =================================

# script to activate vacuum
# script += ur.set_digital_out(IO, signal=True)
# script += ur.sleep(20)
# script += ur.set_digital_out(IO, signal=False)

script = "" #create empty string


def pickup_brick(script, pick_up_frame, current_array, array_start):
    frames = []
    
    # Set frame locs
    safe_frame = pick_up_frame.translated(pick_up_frame.zaxis * -SAFE_DIST)
    drop_frame = pick_up_frame.translated(pick_up_frame.yaxis * 30 + pick_up_frame.xaxis * 15)
    safe_array = array_start.translated(array_start.zaxis * -SAFE_DIST)
    brick_bump = pick_up_frame.translated(pick_up_frame.xaxis * 18 + pick_up_frame.zaxis * 5)
    brick_bump_safe = brick_bump.translated(brick_bump.xaxis * 15)
    

    # Move to safe frame
    script += ur.move_j([-2.13, -1.73, 1.84, -1.75, -1.63, 0.06], acceleration, velocity)
    # Move to array start
    script += ur.move_l(safe_array, acceleration, velocity)
    script += ur.move_l(current_array, acceleration, velocity)
    script += ur.set_digital_out(IO, signal=True)
    script += ur.sleep(1)
    script += ur.move_l(safe_array, acceleration, velocity)
    script += ur.move_j([-2.13, -1.73, 1.84, -1.75, -1.63, 0.06], acceleration, velocity)
    # Move to drop frame
    script += ur.move_l(safe_frame, acceleration, velocity)
    script += ur.move_l(drop_frame, acceleration, velocity)
    script += ur.sleep(1)
    script += ur.set_digital_out(IO, signal=False)
    # Bump dat shit
    script += ur.move_l(safe_frame, acceleration, velocity)
    script += ur.move_l(brick_bump_safe, acceleration, velocity)
    script += ur.move_l(brick_bump, acceleration, velocity)
    script += ur.move_l(brick_bump_safe, acceleration, velocity)
    script += ur.move_l(safe_frame, acceleration, velocity)
    # Move to pick location
    script += ur.move_l(safe_frame, acceleration, velocity)
    script += ur.move_l(pick_up_frame, acceleration, velocity)
    # Activate gripper
    script += ur.set_digital_out(IO, signal=True)
    script += ur.sleep(1)
    # Move back to safe plane
    script += ur.move_l(safe_frame, acceleration, velocity)
    script += ur.move_j([-2.13, -1.73, 1.84, -1.75, -1.63, 0.06], acceleration, velocity)
    return script, frames


def place_brick(script, place_frame):
    frames = []
    
    # Safe frame for placing
    safe_frame = place_frame.translated(place_frame.zaxis * -SAFE_DIST)
    # Add to the path: go to the safe plane
    script += ur.move_l_blend(safe_frame, acceleration, velocity, BLEND_RAD)
    # Add to the path: go to the place plane
    script += ur.move_l_blend(place_frame, acceleration/4, velocity/4, BLEND_RAD)
    # Add to the path: turn off the vacuum and wait 1 second (hold the brick)
    script += ur.sleep(1)
    script += ur.set_digital_out(IO, signal=False)
    # Add to the path: go back to the safe plane
    script += ur.move_l_blend(safe_frame, acceleration/4, velocity/4, BLEND_RAD)
    return script, [safe_frame, place_frame, safe_frame]


#if value given for tcp measured, then add line to script, otherwise it will take current tcp from robot
if tcp_measured is not None:
    script += ur.set_tcp_by_angles(tcp_measured.X, tcp_measured.Y, tcp_measured.Z, m.radians(0.0),m.radians(0.0),m.radians(0))


vis_frames = []

# Generate pick and place sequence
for i in range(len(way_frames)):
    script, pickup_frames = pickup_brick(script, pick_frame, array_frames[i], array_starts[int(i/BRICK_COUNT)])
    script, place_frames = place_brick(script, way_frames[i])
    vis_frames.extend(pickup_frames)
    vis_frames.extend(place_frames)
    if i % 10 == 0 and i > 8:
        script += '\tpopup("R U PAYIN ATTENSHUN?", title="ATTENTION", blocking=True)\n'


# Format the script to make it sendable
script += ur.move_j([-2.13, -1.73, 1.84, -1.75, -1.63, 0.06], acceleration, velocity)
script = com.concatenate_script([script])


# Visualize
from compas_rhino import conversions
import Rhino.Geometry as rg

vis_planes = [conversions.frame_to_rhino(frame) for frame in vis_frames]
count = len(way_frames)
ghenv.Component.Message = "{} BRICKS / {} MOVEL / {} MOVEJ".format(count, script.count("movel("), script.count("movej("))
print("URScript ready: {} bricks, {} characters. Read the script output (not out).".format(count, len(script)))
# ---------- end compas ----------
compas_draw_5 = COMPASDraw(cg=compas.vis_frames)  # -> rg; same code as compas_draw
points = PointList(Points=compas.vis_planes, Size=Slider(0, range=0..100))
urscript_full_program = Panel(compas.script)

# ---- group: Send UR script to Robot!
# Send to Robot!
py3_5 = Python3Script(script=compas.script, ip_address=panel, send=Button())  # -> out, a; inputs script: String, ip_address: String, send: Boolean
# ---------- py3_5: Python ----------
import simple_comm as com

if send:
    com.send_script(script,ip_address)
# ---------- end py3_5 ----------

# ----
# Measure pick up location
point_5 = ValueList({"origin", "xaxis", "xypoint"}, selected="origin")  # disabled
capture_5 = Button()  # disabled

# ---- group: 그냥 재는애
capture_pick_3 = CapturePick(robot_ip=panel_2, point_name=point_5, capture=capture_5)  # -> origin, xaxis_pt, xy_pt, info; disabled; same code as capture_pick_2

# ---- group: Z-Offset
py3_6 = Python3Script(origin=capture_pick_3.origin, xaxis_pt=capture_pick_3.xaxis_pt, xy_pt=capture_pick_3.xy_pt)  # -> out, pick_frame; inputs origin: Point3d, xaxis_pt: Point3d, xy_pt: Point3d; disabled
# ---------- py3_6: Python ----------
# r: compas
# venv: mas-2627
from compas.geometry import Frame, Point

from compas.geometry import Rotation



from compas_rhino.conversions import point_to_compas



origin = point_to_compas(origin)

xaxis_pt = point_to_compas(xaxis_pt)

xy_pt = point_to_compas(xy_pt)



#define pick frame

pick_frame = Frame(origin, xaxis_pt - origin, xy_pt - origin)

pick_frame = pick_frame.translated(pick_frame.zaxis*1.2)
# ---------- end py3_6 ----------

# ----
pick_calibration_4 = Panel(capture_pick_3.info)  # disabled
compas_draw_6 = COMPASDraw(cg=py3_6.pick_frame)  # -> rg; disabled; same code as compas_draw_2

# ----
# Convert Planes to URScript
compas_2 = Python3Script(
    way_frames=transform_2.transformed_frames,
    tcp_measured=pt_2,
    acceleration=number_slider_3,
    velocity=number_slider_4,
    pick_frame=py3_6.pick_frame,
    brick_heights=data_robot_frames_2.brick_heights,
    brick_widths=data_robot_frames_2.brick_widths,
    part_ids=data_robot_frames_2.part_ids)  # -> out, vis_frames, vis_planes, script, preview_bricks; inputs way_frames: list, tcp_measured: Point3d, acceleration: Double, velocity: Double, brick_heights: list, brick_widths: list, part_ids: list; disabled
# ---------- compas_2: Python ----------
# r: compas
# venv: mas-2627
"""Existing pick/place program generator, with per-brick size and trace IDs.

This component only formats URScript and preview frames. It never sends it.
"""
import os,sys,math
from importlib import reload
from compas.geometry import Box
from compas_rhino import conversions

gh_dir=os.path.dirname(ghenv.Component.OnPingDocument().FilePath)
src_dir=os.path.join(gh_dir,'src')
if src_dir not in sys.path:sys.path.insert(0,src_dir)
import simple_ur_script as ur
import simple_comm as com
reload(ur)

IO=4;SAFE_DIST=50.0
def move_l(frame,accel,velocity):
    # Use the frame's unit quaternion, avoiding the old near-pi approximation.
    q=frame.quaternion;w,x,y,z=q.w,q.x,q.y,q.z
    if w<0:w,x,y,z=-w,-x,-y,-z
    sn=math.sqrt(x*x+y*y+z*z)
    factor=2*math.atan2(sn,w)/sn if sn>1e-12 else 0.0
    pose=[frame.point.x/1000,frame.point.y/1000,frame.point.z/1000,x*factor,y*factor,z*factor]
    a=min(abs(float(accel)),ur.MAX_ACCEL);v=min(abs(float(velocity)),ur.MAX_VELOCITY)
    return 'movel(p[%s], a = %.2f, v = %.2f)\n'%(','.join('%.6f'%n for n in pose),a,v)
script='';vis_frames=[];vis_planes=[];preview_bricks=[]
frames=list(way_frames or []);heights=list(brick_heights or []);widths=list(brick_widths or []);ids=list(part_ids or [])
if not (len(frames)==len(heights)==len(widths)==len(ids)):
    raise ValueError('Frame, brick-size and part-ID counts must match exactly')
if frames and pick_frame is None:raise ValueError('Missing saved pick calibration')
if tcp_measured is not None:
    script+=ur.set_tcp_by_angles(tcp_measured.X,tcp_measured.Y,tcp_measured.Z,0.0,0.0,0.0)
for target,height,width,ident in zip(frames,heights,widths,ids):
    script+='# brick '+str(ident)+'\n'
    safe_pick=pick_frame.translated(pick_frame.zaxis*-SAFE_DIST)
    for frame in (safe_pick,pick_frame):
        script+=move_l(frame,acceleration,velocity);vis_frames.append(frame)
    script+=ur.set_digital_out(IO,True)+ur.sleep(2.0)
    script+=move_l(safe_pick,acceleration,velocity);vis_frames.append(safe_pick)
    safe_place=target.copy();safe_place.point.z+=SAFE_DIST
    for frame in (safe_place,target):
        script+=move_l(frame,acceleration,velocity);vis_frames.append(frame)
    script+=ur.set_digital_out(IO,False)+ur.sleep(1)
    script+=move_l(safe_place,acceleration,velocity);vis_frames.append(safe_place)
    # Input targets are TCP face frames, not brick centres.
    box=Box(32,float(width),float(height));box.frame=target.translated(target.zaxis*float(height)/2)
    preview_bricks.append(box)
script=com.concatenate_script([script]) if frames else ''
vis_planes=[conversions.frame_to_rhino(f) for f in vis_frames]
print('%d bricks / %d movement frames / %d script bytes; not sent'%(len(frames),len(vis_frames),len(script.encode('utf8'))))
# ---------- end compas_2 ----------
plane = Plane(compas_2.vis_planes)  # disabled
number_slider_5 = Slider(7, range=0..100)  # disabled
deconstruct_plane = DeconstructPlane(Plane=compas_2.vis_planes)  # -> Origin, XAxis, YAxis, ZAxis; disabled
compas_draw_7 = COMPASDraw(cg=compas_2.vis_frames)  # -> rg; disabled; same code as compas_draw_2
compas_draw_8 = COMPASDraw(cg=compas_2.preview_bricks)  # -> rg; disabled; same code as compas_draw_2
polyline = PolyLine(Vertices=deconstruct_plane.Origin, Closed=False)  # disabled
points_2 = PointList(Points=compas_2.vis_planes, Size=number_slider_5)  # disabled

panel_7 = Panel(compas_2.script)  # disabled

# ---- group: Send UR script to Robot!
# Send to Robot!
button = Button()  # disabled
send_disabled = Python3Script(script=compas_2.script, ip_address=panel_2, send=button)  # -> out, a; inputs script: String, ip_address: String, send: Boolean; disabled; same code as py3_5
